# Grasshopper definition L2(1).gh (Grasshopper 1.0.8)

cluster = Cluster()

# ----
# Rotate object so vector xyz allign with the unit z vector.
brep = Brep(cluster)
rotation_axis_x = Slider(0, range=-100..100)
rotation_axis_y = Slider(0, range=-100..100)
rotation_axis_z = Slider(1, range=-100..100)
bounding_box = BoundingBox(Content=brep, Plane=PlaneXY(0, 0, 0))  # -> Box, Box_2
geometry = Geometry(bounding_box.Box)
vector_xyz = VectorXYZ(XComponent=rotation_axis_x, YComponent=rotation_axis_y, ZComponent=rotation_axis_z)  # -> Vector, Length
volume = Volume(Geometry=geometry)  # -> Volume, Centroid
unit_z = UnitZ(Factor=1)
cross_product = CrossProduct(VectorA=vector_xyz.Vector, VectorB=unit_z, Unitize=False)  # -> Vector, Length
angle = Angle(VectorA=vector_xyz.Vector, VectorB=unit_z)  # -> Angle, Reflex
rotate_3d = Rotate3D(Geometry=brep, Angle=angle.Angle, Center=volume.Centroid, Axis=cross_product.Vector)  # -> Geometry, Transform

# ----
# Slice Object to labled layers of a given thickness
brep_2 = Brep(rotate_3d.Geometry)
material_thickness = Slider(7, range=1..100)
box = Box(brep_2)
box_corners = BoxCorners(Box=box)  # -> CornerA, CornerB, CornerC, CornerD, CornerE, CornerF, CornerG, CornerH
distance = Distance(PointA=box_corners.CornerG, PointB=box_corners.CornerH)
distance_2 = Distance(PointA=box_corners.CornerD, PointB=box_corners.CornerH)
deconstruct = Deconstruct(Point=box_corners.CornerA)  # -> XComponent, YComponent, ZComponent
division = Division(A=distance_2, B=material_thickness)
number = Number(deconstruct.XComponent)
number_2 = Number(deconstruct.YComponent)
number_3 = Number(deconstruct.ZComponent)
series = Series(Start=0, Step=1, Count=division)
unit_x = UnitX(Factor=1)
expression = Expression(a=series, b=distance, v=unit_x, Expression="a*b*v")
expression_2 = Expression(minZ=number_3, layerNum=series, Thickness=material_thickness, Expression="minZ +( 0.5+layerNum)*Thickness")
construct_point = ConstructPoint(XCoordinate=number, YCoordinate=number_2, ZCoordinate=expression_2)
xy_plane = XYPlane(Origin=construct_point)
brep_plane = BrepPlane(Brep=brep_2, Plane=xy_plane)  # -> Curves, Points
move = Move(Geometry=brep_plane.Curves, Motion=graft(expression))  # -> Geometry, Transform
move_to_plane = MoveToPlane(Geometry=move.Geometry, Plane=PlaneXY(0, 0, 0), Above=True, Below=True)  # -> Geometry, Transform
brep_3 = Brep(move_to_plane.Geometry)
area = Area(Geometry=brep_3)  # -> Area, Centroid
circle = Circle(Plane=area.Centroid, Radius=Slider(1, range=0..1))
text_on_surface = TextOnSurface(Text=graft(series), Font="Sans Bold:no Italic:no", Height=1, Depth=0, BaseLine=circle, BaseSurface=brep_3)

# ==== cluster Cluster

# ----
# Parameturized cat (object)
number_slider = Slider(-1, range=-100..100)
addition = Addition(A=Slider(5, range=-100..100), B=number_slider)
addition_2 = Addition(A=Slider(17, range=-100..100), B=addition)
addition_3 = Addition(A=Slider(3, range=-100..100), B=addition_2)
addition_4 = Addition(A=Slider(7, range=-100..100), B=addition_3)
addition_5 = Addition(A=Slider(2, range=-100..100), B=addition_4)
addition_6 = Addition(A=Slider(0, range=-100..100), B=addition_5)
construct_point = ConstructPoint(XCoordinate=Slider(-11, range=-100..100), YCoordinate=Slider(-37, range=-100..100), ZCoordinate=number_slider)
construct_point_2 = ConstructPoint(XCoordinate=Slider(-11, range=-100..100), YCoordinate=Slider(-37, range=-100..100), ZCoordinate=addition)
construct_point_3 = ConstructPoint(XCoordinate=Slider(-11, range=-100..100), YCoordinate=Slider(-37, range=-100..100), ZCoordinate=addition_2)
construct_point_4 = ConstructPoint(XCoordinate=Slider(-11, range=-100..100), YCoordinate=Slider(-37, range=-100..100), ZCoordinate=addition_3)
construct_point_5 = ConstructPoint(XCoordinate=Slider(-11, range=-100..100), YCoordinate=Slider(-37, range=-100..100), ZCoordinate=addition_4)
construct_point_6 = ConstructPoint(XCoordinate=Slider(-13, range=-100..100), YCoordinate=Slider(-44, range=-100..100), ZCoordinate=addition_5)
construct_point_7 = ConstructPoint(XCoordinate=Slider(-15, range=-100..100), YCoordinate=Slider(-30, range=-100..100), ZCoordinate=addition_6)
construct_plane = ConstructPlane(Origin=construct_point, XAxis=Vector(1, 0, 0), YAxis=Vector(0, 1, 0))
construct_plane_2 = ConstructPlane(Origin=construct_point_2, XAxis=Vector(1, 0, 0), YAxis=Vector(0, 1, 0))
construct_plane_3 = ConstructPlane(Origin=construct_point_3, XAxis=Vector(1, 0, 0), YAxis=Vector(0, 1, 0))
construct_plane_4 = ConstructPlane(Origin=construct_point_4, XAxis=Vector(1, 0, 0), YAxis=Vector(0, 1, 0))
construct_plane_5 = ConstructPlane(Origin=construct_point_5, XAxis=Vector(1, 0, 0), YAxis=Vector(0, 1, 0))
construct_plane_6 = ConstructPlane(Origin=construct_point_6, XAxis=Vector(1, 0, 0), YAxis=Vector(0, 1, 0))
construct_plane_7 = ConstructPlane(Origin=construct_point_7, XAxis=Vector(1, 0, 0), YAxis=Vector(0, 1, 0))
ellipse = Ellipse(Plane=construct_plane, Radius1=Slider(7, range=0..100), Radius2=Slider(7, range=0..100))  # -> Ellipse, Focus1, Focus2
ellipse_2 = Ellipse(Plane=construct_plane_2, Radius1=Slider(9, range=0..100), Radius2=Slider(11, range=0..100))  # -> Ellipse, Focus1, Focus2
ellipse_3 = Ellipse(Plane=construct_plane_3, Radius1=Slider(3, range=0..100), Radius2=Slider(3, range=0..100))  # -> Ellipse, Focus1, Focus2
ellipse_4 = Ellipse(Plane=construct_plane_4, Radius1=Slider(8, range=0..100), Radius2=Slider(8, range=0..100))  # -> Ellipse, Focus1, Focus2
ellipse_5 = Ellipse(Plane=construct_plane_5, Radius1=Slider(0, range=0..100), Radius2=Slider(0, range=0..100))  # -> Ellipse, Focus1, Focus2
ellipse_6 = Ellipse(Plane=construct_plane_6, Radius1=Slider(0, range=0..100), Radius2=Slider(1, range=0..100))  # -> Ellipse, Focus1, Focus2
ellipse_7 = Ellipse(Plane=construct_plane_7, Radius1=Slider(0, range=0..100), Radius2=Slider(1, range=0..100))  # -> Ellipse, Focus1, Focus2
merge = Merge(Data1=ellipse_6.Ellipse, Data2=ellipse_4.Ellipse)
merge_2 = Merge(Data1=ellipse_7.Ellipse, Data2=ellipse_4.Ellipse)
merge_3 = Merge(
    Data1=ellipse_5.Ellipse,
    Data3=ellipse_4.Ellipse,
    Data4=ellipse_3.Ellipse,
    Data5=ellipse_2.Ellipse,
    Data6=ellipse.Ellipse)
loft = Loft(Curves=merge, Options={Adjust=False, Closed=False, LoftEnds=0, LoftSimp=0, LoftType=0, Rebuild=10, Refit=0.01})
loft_2 = Loft(Curves=merge_2, Options={Adjust=False, Closed=False, LoftEnds=0, LoftSimp=0, LoftType=0, Rebuild=10, Refit=0.01})
cap_holes = CapHoles(Brep=loft_2)
loft_3 = Loft(Curves=merge_3, Options={Adjust=False, Closed=False, LoftEnds=0, LoftSimp=0, LoftType=0, Rebuild=10, Refit=0.01})
cap_holes_2 = CapHoles(Brep=loft_3)
brep = Brep(cap_holes_2)
cap_holes_3 = CapHoles(Brep=loft)
brep_2 = Brep(cap_holes)
brep_3 = Brep(cap_holes_3)
solid_union = SolidUnion(Breps=[brep, brep_3, brep_2])

result = ClusterOutput(solid_union)
