# Grasshopper definition L2-clean.gh (Grasshopper 1.0.8)

head_base_radius = Slider(42.369, range=0..100)
ears_base_gap = Slider(3, range=0..100)
ears_base_radius = Slider(15, range=15..50)
body_height = Slider(30, range=0..100)
head_top_radius = Slider(1, range=1..50)
base_radius = Slider(30, range=0..100)
ears_top_radius = Slider(0.53, range=0..50)
ears_height = Slider(12.949, range=0.999..50)
head_height = Slider(20.531, range=0..100)
# Generate a cat brep
ears_top_gap = Slider(15, range=15..100)
cluster = Cluster(
    A=ears_top_gap,
    ears_top_radius=ears_top_radius,
    A_4=ears_height,
    A_3=ears_base_gap,
    ears_base_radius=ears_base_radius,
    body_height=body_height,
    radius_3=head_top_radius,
    A_2=head_height,
    radius_2=head_base_radius,
    radius=base_radius)
# Generate the slicing curves
cluster_2 = Cluster_3(x_component=0, y_component=0, z_component=1, brep=cluster, material_thickness=Slider(2, range=0..10))  # -> geometry, angle, center, axis, surfaces
# Project the slicing curves along the X axis,
# mark their centroids,
# and number them
project_layers = ProjectLayers(
    geometry=cluster_2.geometry,
    angle=cluster_2.angle,
    center=cluster_2.center,
    axis=cluster_2.axis,
    y_component=Slider(7, range=0..100))  # -> numbers, centroid, slices
point = Point(project_layers.centroid)
geometry = Geometry(project_layers.numbers)
geometry_2 = Geometry(project_layers.slices)

# ==== cluster Cluster
ears_top_radius = ClusterInput()
ears_base_radius = ClusterInput()
body_height = ClusterInput()
A = ClusterInput()
A_2 = ClusterInput()
A_3 = ClusterInput()
radius = ClusterInput()
radius_2 = ClusterInput()
radius_3 = ClusterInput()
A_4 = ClusterInput()

# ----
# Make a Cat blob
circle = Circle(Plane=PlaneXY(0, 0, 0), Radius=ears_top_radius)
circle_2 = Circle(Plane=PlaneXY(0, 0, 0), Radius=ears_top_radius)
addition = Addition(A=A, B=ears_top_radius)
addition_2 = Addition(A=A_2, B=body_height)
addition_3 = Addition(A=A_3, B=ears_base_radius)
unit_y = UnitY(Factor=addition)
circle_3 = Circle(Plane=PlaneXY(0, 0, 0), Radius=ears_base_radius)
circle_4 = Circle(Plane=PlaneXY(0, 0, 0), Radius=radius)
circle_5 = Circle(Plane=PlaneXY(0, 0, 0), Radius=radius_2)
circle_6 = Circle(Plane=PlaneXY(0, 0, 0), Radius=ears_base_radius)
unit_y_2 = UnitY(Factor=addition_3)
unit_z = UnitZ(Factor=addition_2)
unit_z_2 = UnitZ(Factor=body_height)
negative = Negative(Value=unit_y)
circle_7 = Circle(Plane=PlaneXY(0, 0, 0), Radius=radius_3)
move = Move(Geometry=circle_2, Motion=unit_y)  # -> Geometry, Transform
addition_4 = Addition(A=A_4, B=addition_2)
move_2 = Move(Geometry=circle_5, Motion=unit_z_2)  # -> Geometry, Transform
move_3 = Move(Geometry=circle_7, Motion=unit_z)  # -> Geometry, Transform
move_4 = Move(Geometry=circle, Motion=negative)  # -> Geometry, Transform
negative_2 = Negative(Value=unit_y_2)
unit_z_3 = UnitZ(Factor=addition_4)
merge = Merge(Data1=move_3.Geometry, Data2=move_2.Geometry, Data3=circle_4)
move_5 = Move(Geometry=circle_3, Motion=negative_2)  # -> Geometry, Transform
move_6 = Move(Geometry=circle_6, Motion=unit_y_2)  # -> Geometry, Transform
move_7 = Move(Geometry=move_4.Geometry, Motion=unit_z_3)  # -> Geometry, Transform
move_8 = Move(Geometry=move.Geometry, Motion=unit_z_3)  # -> Geometry, Transform
loft = Loft(Curves=merge, Options={Adjust=False, Closed=False, LoftEnds=0, LoftSimp=0, LoftType=0, Rebuild=10, Refit=0.01})
move_9 = Move(Geometry=move_6.Geometry, Motion=unit_z)  # -> Geometry, Transform
move_10 = Move(Geometry=move_5.Geometry, Motion=unit_z)  # -> Geometry, Transform
loft_2 = Loft(
    Curves=[move_8.Geometry, move_9.Geometry, circle_4],
    Options={Adjust=False, Closed=False, LoftEnds=0, LoftSimp=0, LoftType=0, Rebuild=10, Refit=0.01})
loft_3 = Loft(
    Curves=[move_7.Geometry, move_10.Geometry, circle_4],
    Options={Adjust=False, Closed=False, LoftEnds=0, LoftSimp=0, LoftType=0, Rebuild=10, Refit=0.01})
cap_holes = CapHoles(Brep=[loft_3, loft_2, loft])
solid_union = SolidUnion(Breps=cap_holes)

result = ClusterOutput(solid_union)

# ==== cluster Cluster_3
material_thickness = ClusterInput()
# Rotate object so {x,y,z} alligns with {0,0,1}
# Slice the rotated object along the z axis
# with the given thickness,
# rotate the object and the cross-sectional
# curves back to the original orientation,
x_component = ClusterInput()
y_component = ClusterInput()
z_component = ClusterInput()
brep = ClusterInput()

rotate = Rotate(x_component=x_component, y_component=y_component, z_component=z_component, brep=brep)  # -> geometry_2, angle_2, centroid, axis
cluster = Cluster_2(brep=rotate.geometry_2, material_thickness=material_thickness)
negative = Negative(Value=rotate.angle_2)
rotate_3d = Rotate3D(Geometry=cluster, Angle=negative, Center=rotate.centroid, Axis=rotate.axis)  # -> Geometry, Transform
boundary_surfaces = BoundarySurfaces(Edges=rotate_3d.Geometry)

negative_2 = Negative(Value=negative)
center = ClusterOutput(rotate.centroid)
surfaces = ClusterOutput(boundary_surfaces)
axis = ClusterOutput(rotate.axis)
geometry = ClusterOutput(rotate_3d.Geometry)
angle = ClusterOutput(negative_2)

# ==== cluster ProjectLayers
axis = ClusterInput()
angle = ClusterInput()
center = ClusterInput()
geometry = ClusterInput()

rotate_3d = Rotate3D(Geometry=flatten(geometry), Angle=angle, Center=center, Axis=axis)  # -> Geometry, Transform
bounding_box = BoundingBox(Content=rotate_3d.Geometry, Plane=PlaneXY(0, 0, 0))  # -> Box, Box_2
box_properties = BoxProperties(Box=bounding_box.Box)  # -> Center, Diagonal, Area, Volume, Degeneracy
vector_length = VectorLength(Vector=box_properties.Diagonal)
mass_addition = MassAddition(Input=vector_length)  # -> Result, PartialResults
y_component = ClusterInput()
xy_plane = XYPlane(Origin=Point(0, 0, 0))
vector_xyz = VectorXYZ(XComponent=flatten(mass_addition.PartialResults), YComponent=y_component, ZComponent=0)  # -> Vector, Length
move_to_plane = MoveToPlane(Geometry=rotate_3d.Geometry, Plane=xy_plane, Above=True, Below=True)  # -> Geometry, Transform
# Rotate slices then move them to  XY
# plane and space them out along the x axis
# on y = ycomponent.
move = Move(Geometry=move_to_plane.Geometry, Motion=flatten(vector_xyz.Vector))  # -> Geometry, Transform
boundary_surfaces = BoundarySurfaces(Edges=move.Geometry)

# ----
# Project , number, and space out given slices on XY plane
numid = ClusterInput()
list_length = ListLength(List=rotate_3d.Geometry)
repeat_data = RepeatData(Data=numid, Length=list_length)
series = Series(Start=0, Step=1, Count=list_length)
merge = Merge(Data1=graft(repeat_data), Data2=graft(series))
area = Area(Geometry=move.Geometry)  # -> Area, Centroid
text_join = TextJoin(Text=merge)
scale = Scale(Geometry=move.Geometry, Center=area.Centroid, Factor=0.5)  # -> Geometry, Transform
# Generate number labels of the form “NumID i”
# where numID is an identifier to distinguish differelt axis slices,
#  and i is the slice number in given set of singele axis slices.
text_on_surface = TextOnSurface(
    Text=flatten(text_join),
    Font="Sans Bold:no Italic:no",
    Height=1,
    Depth=0,
    BaseLine=scale.Geometry,
    BaseSurface=boundary_surfaces)
xy_plane_2 = XYPlane(Origin=Point(0, 0, 0))
move_to_plane_2 = MoveToPlane(Geometry=text_on_surface, Plane=xy_plane_2, Above=True, Below=True)  # -> Geometry, Transform

slices = ClusterOutput(move.Geometry)
centroid = ClusterOutput(area.Centroid)
numbers = ClusterOutput(move_to_plane_2.Geometry)

# ==== cluster Rotate
brep = ClusterInput()
# Rotate object so vector xyz allign with the unit z vector.
brep_2 = Brep(brep)
x_component = ClusterInput()
y_component = ClusterInput()
z_component = ClusterInput()
geometry = Geometry(brep_2)
vector_xyz = VectorXYZ(XComponent=x_component, YComponent=y_component, ZComponent=z_component)  # -> Vector, Length
volume = Volume(Geometry=geometry)  # -> Volume, Centroid
unit_z = UnitZ(Factor=1)
cross_product = CrossProduct(VectorA=vector_xyz.Vector, VectorB=unit_z, Unitize=False)  # -> Vector, Length
angle = Angle(VectorA=vector_xyz.Vector, VectorB=unit_z)  # -> Angle, Reflex
rotate_3d = Rotate3D(Geometry=brep_2, Angle=angle.Angle, Center=volume.Centroid, Axis=cross_product.Vector)  # -> Geometry, Transform
geometry_2 = ClusterOutput(rotate_3d.Geometry)
angle_2 = ClusterOutput(angle.Angle)
centroid = ClusterOutput(volume.Centroid)
axis = ClusterOutput(cross_product.Vector)

# ==== cluster Cluster_2
brep = ClusterInput()
brep_2 = Brep(brep)
material_thickness = ClusterInput()

# ----
# Slice Object
box = Box(brep_2)
box_corners = BoxCorners(Box=box)  # -> CornerA, CornerB, CornerC, CornerD, CornerE, CornerF, CornerG, CornerH
distance = Distance(PointA=box_corners.CornerD, PointB=box_corners.CornerH)
deconstruct = Deconstruct(Point=box_corners.CornerA)  # -> XComponent, YComponent, ZComponent
division = Division(A=distance, B=material_thickness)
number = Number(deconstruct.XComponent)
number_2 = Number(deconstruct.YComponent)
number_3 = Number(deconstruct.ZComponent)
series = Series(Start=0, Step=1, Count=division)
expression = Expression(minZ=number_3, layerNum=series, Thickness=material_thickness, Expression="minZ +( 0.5+layerNum)*Thickness")
construct_point = ConstructPoint(XCoordinate=number, YCoordinate=number_2, ZCoordinate=expression)
xy_plane = XYPlane(Origin=construct_point)
brep_plane = BrepPlane(Brep=brep_2, Plane=xy_plane)  # -> Curves, Points

curves = ClusterOutput(brep_plane.Curves)
