# Grasshopper definition L2.gh (Grasshopper 1.0.8)

number_slider = Slider(-1, range=-100..100)
material_thickness = Slider(1, range=1..100)
rotation_axis_x = Slider(19, range=-100..100)
rotation_axis_y = Slider(1, range=-100..100)
rotation_axis_z = Slider(1, range=-100..100)
rotation_axis_x_2 = Slider(-19, range=-100..100)
rotation_axis_y_2 = Slider(-19, range=-100..100)
rotation_axis_z_2 = Slider(1, range=-100..100)
cluster = Cluster_5(
    y_coordinate_7=Slider(-5, range=-100..100),
    A_6=Slider(0, range=-100..100),
    y_coordinate_6=Slider(7, range=-100..100),
    A_5=Slider(2, range=-100..100),
    y_coordinate_5=Slider(3, range=-100..100),
    A_4=Slider(7, range=-100..100),
    y_coordinate_4=Slider(3, range=-100..100),
    A_3=Slider(3, range=-100..100),
    y_coordinate_3=Slider(3, range=-100..100),
    A=Slider(17, range=-100..100),
    y_coordinate_2=Slider(3, range=-100..100),
    A_2=Slider(5, range=-100..100),
    B=number_slider,
    y_coordinate=Slider(3, range=-100..100),
    z_coordinate=number_slider)
line = Line()
division = Division(A=material_thickness, B=Slider(2, range=0..10))
cluster_2 = Cluster_6(
    radius_1_7=Slider(0, range=0..100),
    radius_2_7=Slider(1, range=0..100),
    radius_1_6=Slider(1, range=0..100),
    radius_2_6=Slider(1, range=0..100),
    radius_1_5=Slider(3, range=0..100),
    radius_2_5=Slider(5, range=0..100),
    radius_1_4=Slider(8, range=0..100),
    radius_2_4=Slider(8, range=0..100),
    radius_1_3=Slider(6, range=0..100),
    radius_2_3=Slider(5, range=0..100),
    radius_1_2=Slider(24, range=0..100),
    radius_2_2=Slider(22, range=0..100),
    radius_1=Slider(2, range=0..100),
    radius_2=Slider(2, range=0..100))
object_1_testing = Object1Testing()
# Slice Brep in 2 directions
# and get the layers with intersections marked.
brep = Brep(object_1_testing)

# ----
# Slice Brep in 2 directions
# and project the sliced layers on the xyPlane
brep_2 = Brep(brep)
material_thickness_2 = Slider(1, range=1..100)
rotation_axis_x_3 = Slider(1, range=-100..100)
rotation_axis_y_3 = Slider(1, range=-100..100)
rotation_axis_z_3 = Slider(1, range=-100..100)
rotation_axis_x_4 = Slider(0, range=-100..100)
rotation_axis_y_4 = Slider(0, range=-100..100)
rotation_axis_z_4 = Slider(1, range=-100..100)
cluster_3 = Cluster_3(
    x_component=rotation_axis_x_3,
    y_component=rotation_axis_y_3,
    z_component=rotation_axis_z_3,
    brep=brep_2,
    material_thickness=material_thickness_2)  # -> geometry, angle, center, axis, surfaces
cluster_4 = Cluster_3(
    x_component=rotation_axis_x_2,
    y_component=rotation_axis_y_2,
    z_component=rotation_axis_z_4,
    brep=brep_2,
    material_thickness=material_thickness_2)  # -> geometry, angle, center, axis, surfaces
list_length = ListLength(List=flatten(cluster_4.surfaces))
list_length_2 = ListLength(List=flatten(cluster_3.surfaces))
cluster_5 = Cluster_4(
    numid="T",
    geometry=cluster_4.geometry,
    angle=cluster_4.angle,
    center=cluster_4.center,
    axis=cluster_4.axis,
    y_component=Slider(19, range=-100..100))  # -> numbers, slices
cluster_6 = Cluster_4(
    numid="B",
    geometry=cluster_3.geometry,
    angle=cluster_3.angle,
    center=cluster_3.center,
    axis=cluster_3.axis,
    y_component=Slider(-17, range=-100..100))  # -> numbers, slices
geometry = Geometry(cluster_5.slices)
geometry_2 = Geometry(cluster_6.slices)

cluster_7 = Cluster_3(
    x_component=rotation_axis_x,
    y_component=rotation_axis_y,
    z_component=rotation_axis_z,
    brep=brep,
    material_thickness=material_thickness)  # -> geometry, angle, center, axis, surfaces
cluster_8 = Cluster_3(
    x_component=rotation_axis_x_2,
    y_component=rotation_axis_y_2,
    z_component=rotation_axis_z_2,
    brep=brep,
    material_thickness=material_thickness)  # -> geometry, angle, center, axis, surfaces
brep_brep = BrepBrep(BrepA=cluster_8.geometry, BrepB=flatten(cluster_7.geometry))  # -> Curves, Points
curve_middle = CurveMiddle(Curve=brep_brep.Curves)
end_points = EndPoints(Curve=brep_brep.Curves)  # -> Start, End
list_length_3 = ListLength(List=cluster_8.geometry)
panel = Panel(cluster_7.geometry)
duplicate_data = DuplicateData(Data=brep_brep.Curves, Number=2, Order=True)
merge = Merge(Data1=brep_brep.Curves, Data2=cluster_7.geometry)
surface_curve = SurfaceCurve(Surface=flatten(cluster_8.geometry), Curve=brep_brep.Curves)  # -> Curves, Points, UVPoints, Normals, Parameters, Tangents
negative = Negative(Value=division)
panel_2 = Panel(surface_curve.Curves)
panel_3 = Panel(brep_brep.Curves)
move_away_from = MoveAwayFrom(Geometry=duplicate_data, Emitter=brep_brep.Curves, Distance=negative)  # -> Geometry, Transform
move_away_from_2 = MoveAwayFrom(Geometry=duplicate_data, Emitter=brep_brep.Curves, Distance=division)  # -> Geometry, Transform
clean_tree = CleanTree(RemoveNulls=True, RemoveInvalid=True, RemoveEmpty=Toggle(True), Tree=surface_curve.Curves)
brep_3 = Brep(object_1_testing)
cluster_9 = Cluster()

# ----
# Rotate object so vector xyz allign with the unit z vector.
brep_4 = Brep(brep_3)
rotation_axis_x_5 = Slider(0, range=-100..100)
rotation_axis_y_5 = Slider(0, range=-100..100)
rotation_axis_z_5 = Slider(1, range=-100..100)
geometry_3 = Geometry(brep_4)
vector_xyz = VectorXYZ(XComponent=rotation_axis_x_5, YComponent=rotation_axis_y_5, ZComponent=rotation_axis_z_5)  # -> Vector, Length
volume = Volume(Geometry=geometry_3)  # -> Volume, Centroid
unit_z = UnitZ(Factor=1)
cross_product = CrossProduct(VectorA=vector_xyz.Vector, VectorB=unit_z, Unitize=False)  # -> Vector, Length
angle = Angle(VectorA=vector_xyz.Vector, VectorB=unit_z)  # -> Angle, Reflex
rotate_3d = Rotate3D(Geometry=brep_4, Angle=angle.Angle, Center=volume.Centroid, Axis=cross_product.Vector)  # -> Geometry, Transform

material_thickness_3 = Slider(1, range=1..100)
# Rotate object to align the given vector with z-unit,
# slice the rotated object,
# then r-rotate it and its slices back to the original position
rotation_axis_x_6 = Slider(-20, range=-100..100)
rotation_axis_y_6 = Slider(-25, range=-100..100)
rotation_axis_z_6 = Slider(1, range=-100..100)
brep_5 = Brep(object_1_testing)
rotate = Rotate(x_component=rotation_axis_x_6, y_component=rotation_axis_y_6, z_component=rotation_axis_z_6, brep=brep_5)  # -> geometry_2, angle_2, centroid, axis
cluster_10 = Cluster_2(brep=rotate.geometry_2, material_thickness=material_thickness_3)
negative_2 = Negative(Value=rotate.angle_2)
rotate_3d_2 = Rotate3D(Geometry=cluster_10, Angle=negative_2, Center=rotate.centroid, Axis=rotate.axis)  # -> Geometry, Transform
negative_3 = Negative(Value=negative_2)
boundary_surfaces = BoundarySurfaces(Edges=rotate_3d_2.Geometry)
rotate_3d_3 = Rotate3D(Geometry=rotate_3d_2.Geometry, Angle=negative_3, Center=rotate.centroid, Axis=rotate.axis)  # -> Geometry, Transform

# ----
# Slice Object to labled layers of a given thickness
brep_6 = Brep(rotate_3d.Geometry)
material_thickness_4 = Slider(1, range=1..100)
box = Box(brep_6)
box_corners = BoxCorners(Box=box)  # -> CornerA, CornerB, CornerC, CornerD, CornerE, CornerF, CornerG, CornerH
distance = Distance(PointA=box_corners.CornerG, PointB=box_corners.CornerH)
distance_2 = Distance(PointA=box_corners.CornerD, PointB=box_corners.CornerH)
deconstruct = Deconstruct(Point=box_corners.CornerA)  # -> XComponent, YComponent, ZComponent
division_2 = Division(A=distance_2, B=material_thickness_4)
number = Number(deconstruct.XComponent)
number_2 = Number(deconstruct.YComponent)
number_3 = Number(deconstruct.ZComponent)
series = Series(Start=0, Step=1, Count=division_2)
unit_x = UnitX(Factor=1)
expression = Expression(a=series, b=distance, v=unit_x, Expression="a*b*v")
expression_2 = Expression(minZ=number_3, layerNum=series, Thickness=material_thickness_4, Expression="minZ +( 0.5+layerNum)*Thickness")
construct_point = ConstructPoint(XCoordinate=number, YCoordinate=number_2, ZCoordinate=expression_2)
xy_plane = XYPlane(Origin=construct_point)
brep_plane = BrepPlane(Brep=brep_6, Plane=xy_plane)  # -> Curves, Points
move = Move(Geometry=brep_plane.Curves, Motion=graft(expression))  # -> Geometry, Transform
move_to_plane = MoveToPlane(Geometry=move.Geometry, Plane=PlaneXY(0, 0, 0), Above=True, Below=True)  # -> Geometry, Transform
brep_7 = Brep(move_to_plane.Geometry)
area = Area(Geometry=brep_7)  # -> Area, Centroid
circle = Circle(Plane=area.Centroid, Radius=Slider(1, range=0..1))
text_on_surface = TextOnSurface(Text=graft(series), Font="Sans Bold:no Italic:no", Height=1, Depth=0, BaseLine=circle, BaseSurface=brep_7)

trim_tree = TrimTree(Tree=clean_tree, Depth=Slider(2, range=0..10))
rotate_3d_4 = Rotate3D(Geometry=trim_tree, Angle=cluster_7.angle, Center=cluster_7.center, Axis=cluster_7.axis)  # -> Geometry, Transform
tree_item = TreeItem(Tree=trim_tree, Path="{0;0}", Index=Slider(4, range=0..10), Wrap=True)
simplify_tree = SimplifyTree(Tree=rotate_3d_4.Geometry, Front=Toggle(True))
panel_4 = Panel(trim_tree)
panel_5 = Panel(clean_tree)
bounding_box = BoundingBox(Content=flatten(cluster_8.geometry), Plane=PlaneXY(0, 0, 0))  # -> Box, Box_2
explode_tree = ExplodeTree(Data=trim_tree)  # -> Branch0, Branch1
tree_statistics = TreeStatistics(Tree=trim_tree)  # -> Paths, Length, Count
box_properties = BoxProperties(Box=bounding_box.Box)  # -> Center, Diagonal, Area, Volume, Degeneracy
curve = Curve(explode_tree.Branch1)
curve_2 = Curve(explode_tree.Branch0)
vector_length = VectorLength(Vector=box_properties.Diagonal)
mass_addition = MassAddition(Input=vector_length)  # -> Result, PartialResults
xy_plane_2 = XYPlane(Origin=Point(0, 0, 0))
move_to_plane_2 = MoveToPlane(Geometry=rotate_3d_4.Geometry, Plane=xy_plane_2, Above=True, Below=True)  # -> Geometry, Transform
vector_xyz_2 = VectorXYZ(XComponent=flatten(mass_addition.PartialResults), YComponent=Slider(-5, range=-100..100), ZComponent=0)  # -> Vector, Length
list_length_4 = ListLength(List=move_to_plane_2.Geometry)
panel_6 = Panel(list_length_4)
cross_reference = CrossReference(CrossMode=1)  # -> ListListA, ListListB
repeat_data = RepeatData(Data=vector_xyz_2.Vector, Length=list_length_4)
# Rotate slices then move them  XY plane
# and space them out.
move_2 = Move(Geometry=simplify(move_to_plane_2.Geometry), Motion=simplify(repeat_data))  # -> Geometry, Transform

# ----
# Useful Clusters ( hover over box to see name)
curves = Cluster_3(x_component=0, y_component=0, z_component=0)  # -> geometry, angle, center, axis, surfaces
rotate_2 = Rotate(x_component=0, y_component=0, z_component=0)  # -> geometry_2, angle_2, centroid, axis
rotate_3 = Rotate(x_component=0, y_component=0, z_component=0)  # -> geometry_2, angle_2, centroid, axis
project_layers = Cluster_4(angle=1.570796327, center=Point(0, 0, 0), axis=Vector(0, 0, 1), y_component=0)  # -> numbers, slices

geometry_4 = Geometry([move_to_plane.Geometry, text_on_surface])

# ==== cluster Rotate
brep = ClusterInput()
# Rotate object so vector xyz allign with the unit z vector.
brep_2 = Brep(brep)
x_component = ClusterInput()
y_component = ClusterInput()
z_component = ClusterInput()
geometry = Geometry(brep_2)
vector_xyz = VectorXYZ(XComponent=x_component, YComponent=y_component, ZComponent=z_component)  # -> Vector, Length
volume = Volume(Geometry=geometry)  # -> Volume, Centroid
unit_z = UnitZ(Factor=1)
cross_product = CrossProduct(VectorA=vector_xyz.Vector, VectorB=unit_z, Unitize=False)  # -> Vector, Length
angle = Angle(VectorA=vector_xyz.Vector, VectorB=unit_z)  # -> Angle, Reflex
rotate_3d = Rotate3D(Geometry=brep_2, Angle=angle.Angle, Center=volume.Centroid, Axis=cross_product.Vector)  # -> Geometry, Transform
geometry_2 = ClusterOutput(rotate_3d.Geometry)
angle_2 = ClusterOutput(angle.Angle)
centroid = ClusterOutput(volume.Centroid)
axis = ClusterOutput(cross_product.Vector)

# ==== cluster Cluster

# ==== cluster Cluster_3
material_thickness = ClusterInput()
x_component = ClusterInput()
y_component = ClusterInput()
z_component = ClusterInput()
brep = ClusterInput()

rotate = Rotate(x_component=x_component, y_component=y_component, z_component=z_component, brep=brep)  # -> geometry_2, angle_2, centroid, axis
cluster = Cluster_2(brep=rotate.geometry_2, material_thickness=material_thickness)
negative = Negative(Value=rotate.angle_2)
rotate_3d = Rotate3D(Geometry=cluster, Angle=negative, Center=rotate.centroid, Axis=rotate.axis)  # -> Geometry, Transform
boundary_surfaces = BoundarySurfaces(Edges=rotate_3d.Geometry)

negative_2 = Negative(Value=negative)
center = ClusterOutput(rotate.centroid)
surfaces = ClusterOutput(boundary_surfaces)
axis = ClusterOutput(rotate.axis)
geometry = ClusterOutput(rotate_3d.Geometry)
angle = ClusterOutput(negative_2)

# ==== cluster Cluster_4
axis = ClusterInput()
angle = ClusterInput()
center = ClusterInput()
geometry = ClusterInput()

rotate_3d = Rotate3D(Geometry=flatten(geometry), Angle=angle, Center=center, Axis=axis)  # -> Geometry, Transform
bounding_box = BoundingBox(Content=rotate_3d.Geometry, Plane=PlaneXY(0, 0, 0))  # -> Box, Box_2
box_properties = BoxProperties(Box=bounding_box.Box)  # -> Center, Diagonal, Area, Volume, Degeneracy
vector_length = VectorLength(Vector=box_properties.Diagonal)
mass_addition = MassAddition(Input=vector_length)  # -> Result, PartialResults
y_component = ClusterInput()
xy_plane = XYPlane(Origin=Point(0, 0, 0))
vector_xyz = VectorXYZ(XComponent=flatten(mass_addition.PartialResults), YComponent=y_component, ZComponent=0)  # -> Vector, Length
move_to_plane = MoveToPlane(Geometry=rotate_3d.Geometry, Plane=xy_plane, Above=True, Below=True)  # -> Geometry, Transform
# Rotate slices then move them  XY plane
# and space them out.
move = Move(Geometry=move_to_plane.Geometry, Motion=flatten(vector_xyz.Vector))  # -> Geometry, Transform
boundary_surfaces = BoundarySurfaces(Edges=move.Geometry)

# ----
# Project , number, and space out given slices on XY plane
numid = ClusterInput()
list_length = ListLength(List=rotate_3d.Geometry)
repeat_data = RepeatData(Data=numid, Length=list_length)
series = Series(Start=0, Step=1, Count=list_length)
merge = Merge(Data1=graft(repeat_data), Data2=graft(series))
text_join = TextJoin(Text=merge)
area = Area(Geometry=move.Geometry)  # -> Area, Centroid
scale = Scale(Geometry=move.Geometry, Center=area.Centroid, Factor=0.5)  # -> Geometry, Transform
# Generate number labels of the form “NumID i”
# where numID is an identifier to distinguish differelt axis slices,
#  and i is the slice number in given set of singele axis slices.
text_on_surface = TextOnSurface(
    Text=flatten(text_join),
    Font="Sans Bold:no Italic:no",
    Height=0.5,
    Depth=0,
    BaseLine=scale.Geometry,
    BaseSurface=boundary_surfaces)
xy_plane_2 = XYPlane(Origin=Point(0, 0, 0))
move_to_plane_2 = MoveToPlane(Geometry=text_on_surface, Plane=xy_plane_2, Above=True, Below=True)  # -> Geometry, Transform

slices = ClusterOutput(move.Geometry)
numbers = ClusterOutput(move_to_plane_2.Geometry)

# ==== cluster Object1Testing
construct_point = ConstructPoint(XCoordinate=10, YCoordinate=10, ZCoordinate=0)
construct_point_2 = ConstructPoint(XCoordinate=10, YCoordinate=20, ZCoordinate=5)
construct_plane = ConstructPlane(Origin=construct_point, XAxis=Vector(1, 0, 0), YAxis=Vector(0, 1, 0))
construct_plane_2 = ConstructPlane(Origin=construct_point_2, XAxis=Vector(1, 0, 0), YAxis=Vector(0, 1, 0))
circle = Circle(Plane=construct_plane, Radius=5)
circle_2 = Circle(Plane=construct_plane_2, Radius=2)
loft = Loft(
    Curves=[circle_2, circle],
    Options={Adjust=False, Closed=False, LoftEnds=0, LoftSimp=0, LoftType=0, Rebuild=10, Refit=0.01})
cap_holes = CapHoles(Brep=loft)
brep = ClusterOutput(cap_holes)

# ==== cluster Cluster_5
A = ClusterInput()
A_2 = ClusterInput()
B = ClusterInput()
A_3 = ClusterInput()
A_4 = ClusterInput()
A_5 = ClusterInput()
# Parameturized cat (object)
A_6 = ClusterInput()
addition = Addition(A=A_2, B=B)
addition_2 = Addition(A=A, B=addition)
addition_3 = Addition(A=A_3, B=addition_2)
addition_4 = Addition(A=A_4, B=addition_3)
addition_5 = Addition(A=A_5, B=addition_4)
addition_6 = Addition(A=A_6, B=addition_5)
y_coordinate = ClusterInput()
z_coordinate = ClusterInput()
construct_point = ConstructPoint(XCoordinate=Slider(0, range=-100..100), YCoordinate=y_coordinate, ZCoordinate=z_coordinate)
y_coordinate_2 = ClusterInput()
y_coordinate_3 = ClusterInput()
y_coordinate_4 = ClusterInput()
y_coordinate_5 = ClusterInput()
y_coordinate_6 = ClusterInput()
y_coordinate_7 = ClusterInput()
construct_point_2 = ConstructPoint(XCoordinate=Slider(0, range=-100..100), YCoordinate=y_coordinate_2, ZCoordinate=addition)
construct_point_3 = ConstructPoint(XCoordinate=Slider(0, range=-100..100), YCoordinate=y_coordinate_3, ZCoordinate=addition_2)
construct_point_4 = ConstructPoint(XCoordinate=Slider(0, range=-100..100), YCoordinate=y_coordinate_4, ZCoordinate=addition_3)
construct_point_5 = ConstructPoint(XCoordinate=Slider(0, range=-100..100), YCoordinate=y_coordinate_5, ZCoordinate=addition_4)
construct_point_6 = ConstructPoint(XCoordinate=Slider(0, range=-100..100), YCoordinate=y_coordinate_6, ZCoordinate=addition_5)
construct_point_7 = ConstructPoint(XCoordinate=Slider(0, range=-100..100), YCoordinate=y_coordinate_7, ZCoordinate=addition_6)
construct_plane = ConstructPlane(Origin=construct_point, XAxis=Vector(1, 0, 0), YAxis=Vector(0, 1, 0))
construct_plane_2 = ConstructPlane(Origin=construct_point_2, XAxis=Vector(1, 0, 0), YAxis=Vector(0, 1, 0))
construct_plane_3 = ConstructPlane(Origin=construct_point_3, XAxis=Vector(1, 0, 0), YAxis=Vector(0, 1, 0))
construct_plane_4 = ConstructPlane(Origin=construct_point_4, XAxis=Vector(1, 0, 0), YAxis=Vector(0, 1, 0))
construct_plane_5 = ConstructPlane(Origin=construct_point_5, XAxis=Vector(1, 0, 0), YAxis=Vector(0, 1, 0))
construct_plane_6 = ConstructPlane(Origin=construct_point_6, XAxis=Vector(1, 0, 0), YAxis=Vector(0, 1, 0))
construct_plane_7 = ConstructPlane(Origin=construct_point_7, XAxis=Vector(1, 0, 0), YAxis=Vector(0, 1, 0))
ellipse = Ellipse(Plane=construct_plane, Radius1=Slider(7, range=0..100), Radius2=Slider(7, range=0..100))  # -> Ellipse, Focus1, Focus2
ellipse_2 = Ellipse(Plane=construct_plane_2, Radius1=Slider(9, range=0..100), Radius2=Slider(11, range=0..100))  # -> Ellipse, Focus1, Focus2
ellipse_3 = Ellipse(Plane=construct_plane_3, Radius1=Slider(3, range=0..100), Radius2=Slider(3, range=0..100))  # -> Ellipse, Focus1, Focus2
ellipse_4 = Ellipse(Plane=construct_plane_4, Radius1=Slider(8, range=0..100), Radius2=Slider(8, range=0..100))  # -> Ellipse, Focus1, Focus2
ellipse_5 = Ellipse(Plane=construct_plane_5, Radius1=Slider(0, range=0..100), Radius2=Slider(0, range=0..100))  # -> Ellipse, Focus1, Focus2
ellipse_6 = Ellipse(Plane=construct_plane_6, Radius1=Slider(0, range=0..100), Radius2=Slider(1, range=0..100))  # -> Ellipse, Focus1, Focus2
ellipse_7 = Ellipse(Plane=construct_plane_7, Radius1=Slider(0, range=0..100), Radius2=Slider(1, range=0..100))  # -> Ellipse, Focus1, Focus2
merge = Merge(Data1=ellipse_6.Ellipse, Data2=ellipse_4.Ellipse)
merge_2 = Merge(Data1=ellipse_7.Ellipse, Data2=ellipse_4.Ellipse)
merge_3 = Merge(
    Data1=ellipse_5.Ellipse,
    Data3=ellipse_4.Ellipse,
    Data4=ellipse_3.Ellipse,
    Data5=ellipse_2.Ellipse,
    Data6=ellipse.Ellipse)
loft = Loft(Curves=merge, Options={Adjust=False, Closed=False, LoftEnds=0, LoftSimp=0, LoftType=0, Rebuild=10, Refit=0.01})
loft_2 = Loft(Curves=merge_2, Options={Adjust=False, Closed=False, LoftEnds=0, LoftSimp=0, LoftType=0, Rebuild=10, Refit=0.01})
cap_holes = CapHoles(Brep=loft_2)
loft_3 = Loft(Curves=merge_3, Options={Adjust=False, Closed=False, LoftEnds=0, LoftSimp=0, LoftType=0, Rebuild=10, Refit=0.01})
cap_holes_2 = CapHoles(Brep=loft_3)
brep = Brep(cap_holes_2)
cap_holes_3 = CapHoles(Brep=loft)
brep_2 = Brep(cap_holes)
brep_3 = Brep(cap_holes_3)
solid_union = SolidUnion(Breps=[brep, brep_3, brep_2])
cat_brep = ClusterOutput(solid_union)

# ==== cluster Cluster_6
number_slider = Slider(-1, range=-100..100)
addition = Addition(A=Slider(18, range=-100..100), B=number_slider)
addition_2 = Addition(A=Slider(17, range=-100..100), B=addition)
addition_3 = Addition(A=Slider(3, range=-100..100), B=addition_2)
addition_4 = Addition(A=Slider(7, range=-100..100), B=addition_3)
addition_5 = Addition(A=Slider(2, range=-100..100), B=addition_4)
# Parameturized cat (object)
addition_6 = Addition(A=Slider(0, range=-100..100), B=addition_5)
construct_point = ConstructPoint(XCoordinate=Slider(0, range=-100..100), YCoordinate=Slider(3, range=-100..100), ZCoordinate=number_slider)
construct_point_2 = ConstructPoint(XCoordinate=Slider(0, range=-100..100), YCoordinate=Slider(3, range=-100..100), ZCoordinate=addition)
construct_point_3 = ConstructPoint(XCoordinate=Slider(0, range=-100..100), YCoordinate=Slider(3, range=-100..100), ZCoordinate=addition_2)
construct_point_4 = ConstructPoint(XCoordinate=Slider(0, range=-100..100), YCoordinate=Slider(3, range=-100..100), ZCoordinate=addition_3)
construct_point_5 = ConstructPoint(XCoordinate=Slider(0, range=-100..100), YCoordinate=Slider(3, range=-100..100), ZCoordinate=addition_4)
construct_point_6 = ConstructPoint(XCoordinate=Slider(0, range=-100..100), YCoordinate=Slider(10, range=-100..100), ZCoordinate=addition_5)
construct_point_7 = ConstructPoint(XCoordinate=Slider(0, range=-100..100), YCoordinate=Slider(-5, range=-100..100), ZCoordinate=addition_6)
construct_plane = ConstructPlane(Origin=construct_point, XAxis=Vector(1, 0, 0), YAxis=Vector(0, 1, 0))
radius_1 = ClusterInput()
radius_2 = ClusterInput()
construct_plane_2 = ConstructPlane(Origin=construct_point_2, XAxis=Vector(1, 0, 0), YAxis=Vector(0, 1, 0))
construct_plane_3 = ConstructPlane(Origin=construct_point_3, XAxis=Vector(1, 0, 0), YAxis=Vector(0, 1, 0))
construct_plane_4 = ConstructPlane(Origin=construct_point_4, XAxis=Vector(1, 0, 0), YAxis=Vector(0, 1, 0))
construct_plane_5 = ConstructPlane(Origin=construct_point_5, XAxis=Vector(1, 0, 0), YAxis=Vector(0, 1, 0))
construct_plane_6 = ConstructPlane(Origin=construct_point_6, XAxis=Vector(1, 0, 0), YAxis=Vector(0, 1, 0))
construct_plane_7 = ConstructPlane(Origin=construct_point_7, XAxis=Vector(1, 0, 0), YAxis=Vector(0, 1, 0))
ellipse = Ellipse(Plane=construct_plane, Radius1=radius_1, Radius2=radius_2)  # -> Ellipse, Focus1, Focus2
radius_1_2 = ClusterInput()
radius_2_2 = ClusterInput()
radius_1_3 = ClusterInput()
radius_2_3 = ClusterInput()
radius_1_4 = ClusterInput()
radius_2_4 = ClusterInput()
radius_1_5 = ClusterInput()
radius_2_5 = ClusterInput()
radius_1_6 = ClusterInput()
radius_2_6 = ClusterInput()
radius_1_7 = ClusterInput()
radius_2_7 = ClusterInput()
ellipse_2 = Ellipse(Plane=construct_plane_2, Radius1=radius_1_2, Radius2=radius_2_2)  # -> Ellipse, Focus1, Focus2
ellipse_3 = Ellipse(Plane=construct_plane_3, Radius1=radius_1_3, Radius2=radius_2_3)  # -> Ellipse, Focus1, Focus2
ellipse_4 = Ellipse(Plane=construct_plane_4, Radius1=radius_1_4, Radius2=radius_2_4)  # -> Ellipse, Focus1, Focus2
ellipse_5 = Ellipse(Plane=construct_plane_5, Radius1=radius_1_5, Radius2=radius_2_5)  # -> Ellipse, Focus1, Focus2
ellipse_6 = Ellipse(Plane=construct_plane_6, Radius1=radius_1_6, Radius2=radius_2_6)  # -> Ellipse, Focus1, Focus2
ellipse_7 = Ellipse(Plane=construct_plane_7, Radius1=radius_1_7, Radius2=radius_2_7)  # -> Ellipse, Focus1, Focus2
merge = Merge(Data1=ellipse_6.Ellipse, Data2=ellipse_4.Ellipse)
merge_2 = Merge(Data1=ellipse_7.Ellipse, Data2=ellipse_4.Ellipse)
merge_3 = Merge(
    Data1=ellipse_5.Ellipse,
    Data3=ellipse_4.Ellipse,
    Data4=ellipse_3.Ellipse,
    Data5=ellipse_2.Ellipse,
    Data6=ellipse.Ellipse)
loft = Loft(Curves=merge, Options={Adjust=False, Closed=False, LoftEnds=0, LoftSimp=0, LoftType=0, Rebuild=10, Refit=0.01})
loft_2 = Loft(Curves=merge_2, Options={Adjust=False, Closed=False, LoftEnds=0, LoftSimp=0, LoftType=0, Rebuild=10, Refit=0.01})
cap_holes = CapHoles(Brep=loft_2)
loft_3 = Loft(Curves=merge_3, Options={Adjust=False, Closed=False, LoftEnds=0, LoftSimp=0, LoftType=0, Rebuild=10, Refit=0.01})
cap_holes_2 = CapHoles(Brep=loft_3)
brep = Brep(cap_holes_2)
cap_holes_3 = CapHoles(Brep=loft)
brep_2 = Brep(cap_holes)
brep_3 = Brep(cap_holes_3)
solid_union = SolidUnion(Breps=[brep, brep_3, brep_2])
cat_brep = ClusterOutput(solid_union)

# ==== cluster Cluster_2
brep = ClusterInput()
brep_2 = Brep(brep)
material_thickness = ClusterInput()

# ----
# Slice Object
box = Box(brep_2)
box_corners = BoxCorners(Box=box)  # -> CornerA, CornerB, CornerC, CornerD, CornerE, CornerF, CornerG, CornerH
distance = Distance(PointA=box_corners.CornerD, PointB=box_corners.CornerH)
deconstruct = Deconstruct(Point=box_corners.CornerA)  # -> XComponent, YComponent, ZComponent
division = Division(A=distance, B=material_thickness)
number = Number(deconstruct.XComponent)
number_2 = Number(deconstruct.YComponent)
number_3 = Number(deconstruct.ZComponent)
series = Series(Start=0, Step=1, Count=division)
expression = Expression(minZ=number_3, layerNum=series, Thickness=material_thickness, Expression="minZ +( 0.5+layerNum)*Thickness")
construct_point = ConstructPoint(XCoordinate=number, YCoordinate=number_2, ZCoordinate=expression)
xy_plane = XYPlane(Origin=construct_point)
brep_plane = BrepPlane(Brep=brep_2, Plane=xy_plane)  # -> Curves, Points

curves = ClusterOutput(brep_plane.Curves)
