# Grasshopper definition L3-3DPSlicerGcodeGeneratorBase.gh (Grasshopper 1.0.8)
# plug-ins: RhinoCodePluginGH, PTComponentLibrary, Pancake

# ---- group: A second line for testing
construct_point = ConstructPoint(XCoordinate=Slider(10, range=-10..30), YCoordinate=Slider(10, range=-10..30), ZCoordinate=Slider(1, range=-10..30))
construct_point_2 = ConstructPoint(XCoordinate=Slider(10, range=-10..30), YCoordinate=Slider(20, range=-10..30), ZCoordinate=Slider(1, range=-10..30))
line = Line(StartPoint=construct_point, EndPoint=construct_point_2)

construct_point_3 = ConstructPoint(XCoordinate=Slider(10, range=-10..30), YCoordinate=Slider(10, range=-10..30), ZCoordinate=Slider(1, range=-10..30))
construct_point_4 = ConstructPoint(XCoordinate=Slider(10, range=-10..30), YCoordinate=Slider(20, range=-10..30), ZCoordinate=Slider(1, range=-10..30))
line_2 = Line(StartPoint=construct_point_3, EndPoint=construct_point_4)

construct_point_5 = ConstructPoint(XCoordinate=Slider(10, range=-10..30), YCoordinate=Slider(10, range=-10..30), ZCoordinate=Slider(1, range=-10..30))
construct_point_6 = ConstructPoint(XCoordinate=Slider(10, range=-10..30), YCoordinate=Slider(20, range=-10..30), ZCoordinate=Slider(1, range=-10..30))
line_3 = Line(StartPoint=construct_point_5, EndPoint=construct_point_6)

construct_point_7 = ConstructPoint(XCoordinate=Slider(10, range=-10..30), YCoordinate=Slider(10, range=-10..30), ZCoordinate=Slider(1, range=-10..30))
construct_point_8 = ConstructPoint(XCoordinate=Slider(10, range=-10..30), YCoordinate=Slider(20, range=-10..30), ZCoordinate=Slider(1, range=-10..30))
line_4 = Line(StartPoint=construct_point_7, EndPoint=construct_point_8)

# ---- group: Example of a line for testing
# [TODO]: Use lines for testing gcode generation then replace with line segments from slicing
number_slider = Slider(5, range=-10..30)
construct_point_9 = ConstructPoint(XCoordinate=number_slider, YCoordinate=Slider(1, range=-10..30), ZCoordinate=Slider(0, range=-10..30))
construct_point_10 = ConstructPoint(XCoordinate=Slider(30, range=-10..30), YCoordinate=Slider(1, range=-10..30), ZCoordinate=Slider(0, range=-10..30))
line_5 = Line(StartPoint=construct_point_9, EndPoint=construct_point_10)

construct_point_11 = ConstructPoint(XCoordinate=Slider(5, range=-10..30), YCoordinate=Slider(1, range=-10..30), ZCoordinate=Slider(0, range=-10..30))
construct_point_12 = ConstructPoint(XCoordinate=Slider(30, range=-10..30), YCoordinate=Slider(1, range=-10..30), ZCoordinate=Slider(0, range=-10..30))
line_6 = Line(StartPoint=construct_point_11, EndPoint=construct_point_12)

construct_point_13 = ConstructPoint(XCoordinate=Slider(5, range=-10..30), YCoordinate=Slider(1, range=-10..30), ZCoordinate=Slider(0, range=-10..30))
construct_point_14 = ConstructPoint(XCoordinate=Slider(30, range=-10..30), YCoordinate=Slider(1, range=-10..30), ZCoordinate=Slider(0, range=-10..30))
line_7 = Line(StartPoint=construct_point_13, EndPoint=construct_point_14)

# ---- group: A second line for testing
construct_point_15 = ConstructPoint(XCoordinate=Slider(10, range=-10..30), YCoordinate=Slider(10, range=-10..30), ZCoordinate=Slider(1, range=-10..30))
construct_point_16 = ConstructPoint(XCoordinate=Slider(10, range=-10..30), YCoordinate=Slider(20, range=-10..30), ZCoordinate=Slider(1, range=-10..30))
line_8 = Line(StartPoint=construct_point_15, EndPoint=construct_point_16)

# ---- group: Example of a line for testing
construct_point_17 = ConstructPoint(XCoordinate=Slider(5, range=-10..30), YCoordinate=Slider(1, range=-10..30), ZCoordinate=Slider(0, range=-10..30))
construct_point_18 = ConstructPoint(XCoordinate=Slider(30, range=-10..30), YCoordinate=Slider(1, range=-10..30), ZCoordinate=Slider(0, range=-10..30))
line_9 = Line(StartPoint=construct_point_17, EndPoint=construct_point_18)

# ---- group: A second line for testing
construct_point_19 = ConstructPoint(XCoordinate=Slider(10, range=-10..30), YCoordinate=Slider(10, range=-10..30), ZCoordinate=Slider(1, range=-10..30))
construct_point_20 = ConstructPoint(XCoordinate=Slider(10, range=-10..30), YCoordinate=Slider(20, range=-10..30), ZCoordinate=Slider(1, range=-10..30))
line_10 = Line(StartPoint=construct_point_19, EndPoint=construct_point_20)

# ---- group: Example of a line for testing
construct_point_21 = ConstructPoint(XCoordinate=Slider(5, range=-10..30), YCoordinate=Slider(1, range=-10..30), ZCoordinate=Slider(0, range=-10..30))
construct_point_22 = ConstructPoint(XCoordinate=Slider(30, range=-10..30), YCoordinate=Slider(1, range=-10..30), ZCoordinate=Slider(0, range=-10..30))
line_11 = Line(StartPoint=construct_point_21, EndPoint=construct_point_22)

# ----
# [TODO]: Implement the gcode generation algorithm in Python
# [TODO]: Initialize Input Parameters
# [TODO]: Use Pancake Plug-in to Export Gcode Output File as .gcode
# NOTE THAT THIS GCODE OUTPUT ASSUMES:
# - A PRUSA MK3S+ as the Printer
# - PLA Material
# - Extrusion Temperature: 215C
# - Heated Bed Temperature: 60C
# Vase Mode
num_layers = Slider(5, range=1..10)
layer_height = Slider(0.3, range=0..5)
multiplication = Multiplication(A=num_layers, B=layer_height)
build_plate_mid = Slider(105, range=0..1000)
cylinder = Cylinder(Base=PlaneXY(0, 0, 0), Radius=10, Length=multiplication)
vector_xyz = VectorXYZ(XComponent=build_plate_mid, YComponent=build_plate_mid, ZComponent=0)  # -> Vector, Length
cap_holes = CapHoles(Brep=cylinder)
move = Move(Geometry=cap_holes, Motion=vector_xyz.Vector)  # -> Geometry, Transform
layer_height_2 = Slider(0.3, range=0..1)
cylender_brep = Brep(move.Geometry)
unit_z = UnitZ(Factor=Slider(0.2, range=0..1))
contour = Contour(Shape=cylender_brep, Point=unit_z, Direction=Vector(0, 0, 1), Distance=layer_height_2)
trim_tree = TrimTree(Tree=simplify(graft(contour)), Depth=Slider(0, range=0..5))
discrete_length = Panel("0.01")
divide_length = DivideLength(Curve=trim_tree, Distance=discrete_length, RoundUp=True, RoundDn=False)
cull_duplicates = CullDuplicates(Points=divide_length, Tolerance=0.1, CullMode=3)  # -> Points, Indices, Valence
item_index = ItemIndex(List=simplify(cull_duplicates.Points), Item=simplify(cull_duplicates.Points))
trim_tree_2 = TrimTree(Tree=cull_duplicates.Points, Depth=2)
list_length = ListLength(List=trim_tree_2)
expression = Expression(numPoints=list_length, index=item_index, layerHeight=layer_height_2, Expression="layerHeight/numPoints * index")
vector_xyz_2 = VectorXYZ(XComponent=0, YComponent=0, ZComponent=expression)  # -> Vector, Length
move_2 = Move(Geometry=cull_duplicates.Points, Motion=vector_xyz_2.Vector)  # -> Geometry, Transform
polyline = PolyLine(Vertices=flatten(move_2.Geometry), Closed=False)
simplify_curve = SimplifyCurve(Curve=flatten(polyline))  # -> Curve, Simplified
explode = Explode(Curve=simplify_curve.Curve, Recursive=True)  # -> flatten(Segments), Vertices
printing_lines = Line(explode.Segments)
extrusion_width_factor = Panel("1.2")
nozzle_diam = Panel("0.4")
number = Number(num_layers)
density = Number("0")
multiplication_2 = Multiplication(A=nozzle_diam, B=extrusion_width_factor)
expression_2 = Expression(
    NumLayers=number,
    Density=density,
    InfillType="Vase",
    Expression="\"/Users/a.../Desktop/Masters/Fall24/CSCI7000_ComFab/CSCI-7000-Computational-Fabrication/code/L3/output-\" & NumLayers & \"l_\"&Density &\"P_\" &InfillType &\"I.gcode\"")
layer_change_feed_rate = Panel("720")
extrusion_feed_rate = Panel("600")
travel_feed_rate = Panel("1200")
filament_diam = Panel("1.75")
layer_height_3 = Panel("0.3")
line_12 = Line([line_11, line_8])
python_3_script_generate_gcode = Python3Script(
    lines=flatten(printing_lines),
    nozzle_diameter=nozzle_diam,
    filament_diameter=filament_diam,
    layer_height=layer_height_3,
    extrusion_width=multiplication_2,
    travel_feed_rate=travel_feed_rate,
    layer_change_feed_rate=layer_change_feed_rate,
    extrusion_feed_rate=extrusion_feed_rate)  # -> out, gcode_output; inputs lines: list of Line, nozzle_diameter: Double, filament_diameter: Double, layer_height: Double, extrusion_width: Double, travel_feed_rate: Double, layer_change_feed_rate: Double, extrusion_feed_rate: Double
# ---------- python_3_script_generate_gcode: Python ----------
"""
    This file contains parameters, helpers, and setup to 
    create a basic gcode generation algorithm from line segments.
    
    The main 
    
    Inputs:
        lines: the line segments to be converted into gcode commands for extrusion 
        nozzle_diameter: the diameter of the 3D printer's nozzle
        filament_diameter: the diameter of the 3d printing filament
        layer_height: the height of each layer in the print
        extrusion_width: the width of the extruded line from the printer
        travel_feed_rate: the speed at which the extruder moves in X and Y
        layer_change_feed_rate: the speed at which teh extruder moves when 
            changing layers in the Z direction
        extrusion_feed_rate: the speed at which the extruder move when extruding

    Output:
        gcode_output: a string with gcode commands separate by new-lines"""

__author__ = "mrivera-cu"

import rhinoscriptsyntax as rs

import math


########## CONSTANTS BELOW ###############

# GCODE COMMANDS
COMMAND_MOVE = "G1"

# GCODE PARAM NAMES
PARAM_X = "X"
PARAM_Y = "Y"
PARAM_Z = "Z"
PARAM_E = "E"
PARAM_F = "F"

# Separates commands
COMMAND_DELIMITER = "\n"

# Precision for converting floats to strings
E_VALUE_PRECISION = 5
XYZ_VALUE_PRECISION = 3

# Float equality precision
FLOAT_EQUALITY_PRECISION = 5

#### WARNING: DO NOT EDIT THE START GCODE! #####
start_gcode_lines = [";START GCODE",
    "M201 X1000 Y1000 Z200 E5000 ; sets maximum accelerations, mm/sec^2",
    "M203 X200 Y200 Z12 E120 ; sets maximum feedrates, mm / sec",
    "M204 S1250 T1250 ; sets acceleration (S) and retract acceleration (R), mm/sec^2",
    "M205 X8.00 Y8.00 Z0.40 E4.50 ; sets the jerk limits, mm/sec",
    "M205 S0 T0 ; sets the minimum extruding and travel feed rate, mm/sec",
    ";TYPE:Custom",
    "M862.3 P \"MK3S\" ; printer model check",
    "M862.1 P0.4 ; nozzle diameter check",
    "M115 U3.13.3 ; tell printer latest fw version",
    "G90 ; use absolute coordinates",
    "M83 ; extruder relative mode",
    "M104 S215 ; set extruder temp",
    "M140 S60 ; set bed temp",
    "M190 S60 ; wait for bed temp",
    "M109 S215 ; wait for extruder temp",
    "G28 W ; home all without mesh bed level",
    "G80 X86.6877 Y64.7708 W85.2412 H59.1573 ; mesh bed levelling",
    "G1 Z0.2 F720",
    "G1 Y-3 F1000 ; go outside print area",
    "G92 E0",
    "G1 X60 E9 F1000 ; intro line",
    "G1 X100 E12.5 F1000 ; intro line",
    "G92 E0",
    "M221 S95",
    "; Don't change E values below. Excessive value can damage the printer.",
    "M907 E538 ; set extruder motor current",
    "G21 ; set units to millimeters",
    "G90 ; use absolute coordinates",
    "M83 ; use relative distances for extrusion",
    "M900 K0.05 ; Filament gcode LA 1.5",
    "M900 K30 ; Filament gcode LA 1.0",
    "M107"]
    
##### WARNING: DO NOT EDIT THE END GCODE! ######
end_gcode_lines = ["; END Gcode", 
    "M204 S1000", 
    "M107", 
    ";TYPE:Custom", 
    "; Filament-specific end gcode", 
    "G1 Z180 F720 ; Move print head further up", 
    "G1 X0 Y200 F3600 ; park", 
    "G4 ; wait",
    "M221 S100 ; reset flow",
    "M900 K0 ; reset LA",
    "M104 S0 ; turn off temperature",
    "M140 S0 ; turn off heatbed",
    "M107 ; turn off fan",
    "M84 ; disable motors",
    "M73 P100 R0 ; print progress done",
    "M73 Q100 S0 ; print progress done"]

#########################################################################

# Converts a float (f) to a string with some precision of decimal places
# For example: 
# Input: f=0.1234, precision=3 
# Output: "0.123"
def float_to_string(f, precision=XYZ_VALUE_PRECISION): 
    f = float(f)
    str_format = "{value:." + str(precision) +"f}"
    return str_format.format(value=f)
    
# Helper to convert the E value to the proper precision
def e_value_to_string(e):
    return float_to_string(e, E_VALUE_PRECISION)

# Helper to convert the XYZ value to the proper precision
def xyz_value_to_string(e):
    return float_to_string(e, XYZ_VALUE_PRECISION)

#########################################################################

# Helper function to compare floats in grasshopper/python due to float precision errors
def are_floats_equal(f1, f2, epsilon=10**(-FLOAT_EQUALITY_PRECISION)):
    f1 *= 10**FLOAT_EQUALITY_PRECISION
    f2 *= 10**FLOAT_EQUALITY_PRECISION
    return math.fabs(f2 - f1) <= epsilon
    
# Helper function to compare if two points are equal (have the same coordinates)
# by handling float precision comparisons
def is_same_pt(ptA, ptB):
    return are_floats_equal(ptA[0], ptB[0]) and are_floats_equal(ptA[1], ptB[1]) and are_floats_equal(ptA[2], ptB[2])
     
     
########################################################################
# creates a string consisting of a G1 move command and 
# any associated parameters
def gcode_move(current_pos, next_pos, feed_rate=None, should_extrude=False):
    # Start with "G1" as command
    move_command_str = COMMAND_MOVE
    
    # Compare X positions
    if (not are_floats_equal(current_pos[0],next_pos[0])):
        # we have a different x position so add it as a parameter to the command
        x_value = float_to_string(next_pos[0], precision=XYZ_VALUE_PRECISION)
        # Add X<x_value> to move string, e.g., X100.00
        move_command_str += " " + PARAM_X + x_value
    
    # Compare Y positions
    if (not are_floats_equal(current_pos[1], next_pos[1])):
        # we have a different y position so add the new position as a parameter
        y_value = float_to_string(next_pos[1], precision=XYZ_VALUE_PRECISION)
        # Add Y<y_value> to move string, e.g., Y100.00
        move_command_str += " " + PARAM_Y + y_value
    
    # Compare Z position
    if (not are_floats_equal(current_pos[2], next_pos[2])):
        # we have a different z position so add the new position as a parameter
        z_value = float_to_string(next_pos[2], precision=XYZ_VALUE_PRECISION)
        # Add Z<z_value> to move string, e.g., Z100.00
        move_command_str += " " + PARAM_Z + z_value
    
    # [TODO]: handle "should_extrude" == true by determining the proper amount to
    # extrude using the capsule model, then append the E parameter and value
    # to the move command.
    # NOTE: YOUR FLOAT PRECISION MUST MATCH E_VALUE_PRECISION
    # E_val = 12.5
    if(should_extrude == True):
        D = filament_diameter
        h = layer_height
        w = extrusion_width
        pi = math.pi
        A = (h*(w-h))+(pi*(h/2)**2)
        L = math.sqrt((current_pos[0]-next_pos[0])**2 + (current_pos[1]-next_pos[1])**2 + (current_pos[2]-next_pos[2])**2)
        E = (A * L)/(pi * ( D/2)**2)
        E_val = E
        # OR E_val += E 
        e_value = float_to_string(E_val, precision=E_VALUE_PRECISION)
        move_command_str += " " + PARAM_E + e_value

    
    # See if we have a feedrate to use, and handle it differently than other 
    # parameters as it is an integer value
    if (feed_rate is not None):
        # feed rate is an int
        feed_rate_value = round(feed_rate)
        # Add F<feed_rate_value> to move string, e.g., F2000
        move_command_str += " " + PARAM_F + str(feed_rate_value)   
    
    # Remove excess whitespace on ends
    move_command_str = move_command_str.strip(" ")
    return move_command_str


############################################
############################################
############################################
    
''' Here's the main method of the script that uses the helper methods above '''

def generate_gcode():

    # [TODO]: Implement the algorithm to generate gcode for each layer by 
    # first to moveing to the layer height, then moving to each line segment.
    # Once at a line segment, you should move and extrude along it, 
    # then move (travel) to the next line until there are no lines left
    # For each of these movements, you should append the command to
    # the list: `all_move_commands`
    current_position = [0, 0, 0]        # start extruder at the origin
    all_move_commands = []              # list to hold for all the move commands

    for i in range(0, len(lines)):
        # Get pts of the line segment
        line = lines[i]
        line_start_position = line.From
        line_end_position = line.To
        
        # [TODO]: Handle moving to the next layer (Z Position)
        # NOTE- ALL Z MOVEMENTS SHOULD:
        # 1) BE INDEPENDENT MOVES(e.g., G1 Z# and not move with other positions like XYE) 
        # 2) USE THE `layer_change_feed_rate`
        # 3) BE IN INCREASING ORDER
        
        if (not are_floats_equal(current_position[2], line_start_position[2])):
            move_up_command = gcode_move(current_position,[current_position[0],current_position[1],line_start_position[2]], feed_rate=layer_change_feed_rate, should_extrude=False)
            all_move_commands.append(move_up_command)
            current_position[2] = line_start_position[2]

        # Now if our current_position is not the start of our line segment
        # we need to move (travel) to the line segment's starting point
        if not is_same_pt(current_position, line_start_position):
            # [Move to the the line_start_position
            move_to_line_start_command = gcode_move(current_position, line_start_position, feed_rate=travel_feed_rate)
            # A ppend command
            all_move_commands.append(move_to_line_start_command)
            current_position = line_start_position
        
        # [TODO]: Once our extruder is at the start of the line, create a 
        # command to move AND extrude along 
        # the line segment using `extrusion_feed_rate`
        move_along_line_command = gcode_move(current_position, line_end_position, feed_rate=extrusion_feed_rate, should_extrude=True)
    
        # [TODO]: Append the move command across the line segment 
        all_move_commands.append(move_along_line_command)
        
        # [TODO]: Update the current position of our extruder to be at the end of the line
        # current_position = [0, 0, 0]
        current_position = line_end_position
    # End of for-loop above -- now create the full set of commands
    # [TODO]: Once you have all of the move commands stored as a list in
    # `all_move_commands`, combine the `start_gcode`, `all_move_commands`, and `end_gcode`
    # into one list called `gcode_lines`   
    gcode_lines = []
    gcode_lines = start_gcode_lines + all_move_commands + end_gcode_lines
    # gcode_lines.append(all_move_commands)
    # # print(all_move_commands)
    # gcode_lines.append(end_gcode_lines)

    # print(gcode_lines)
    # --- DO NOT EDIT BELOW ----
    # The takes the combined gcode_lines list and creates a string containing each line
    # separated by a COMMAND_DELIMITER (the new-line character), and sets it 
    # to the `gcode_output`variable of this component
    output = COMMAND_DELIMITER.join(gcode_lines)
    
    return output
    
''' RUN THE MAIN FUNCITON ABOVE - DO NOT EDIT '''
# this sets the gcode commands to be the the `gcode_output` variable of this grasshopper component
gcode_output = generate_gcode()
# ---------- end python_3_script_generate_gcode ----------
the_gcode_output = Panel(python_3_script_generate_gcode.gcode_output)
debugging_panel = Panel(python_3_script_generate_gcode.out)
true_only_button = TrueOnlyButton(LastSaveLocalization="neutral,N")
panel = Panel(expression_2)
export_txt = ExportTXT(
    Content=python_3_script_generate_gcode.gcode_output,
    FileLocation=expression_2,
    Overwrite=Toggle(True),
    Encoding="utf-8",
    Export=true_only_button,
    LastSaveLocalization="neutral,N")
panel_2 = Panel(export_txt)

# ---- group: Example of a line for testing
construct_point_23 = ConstructPoint(XCoordinate=Slider(5, range=-10..30), YCoordinate=Slider(1, range=-10..30), ZCoordinate=Slider(0, range=-10..30))
construct_point_24 = ConstructPoint(XCoordinate=Slider(30, range=-10..30), YCoordinate=Slider(1, range=-10..30), ZCoordinate=Slider(0, range=-10..30))
line_13 = Line(StartPoint=construct_point_23, EndPoint=construct_point_24)

# ---- group: A second line for testing
construct_point_25 = ConstructPoint(XCoordinate=Slider(10, range=-10..30), YCoordinate=Slider(10, range=-10..30), ZCoordinate=Slider(1, range=-10..30))
construct_point_26 = ConstructPoint(XCoordinate=Slider(10, range=-10..30), YCoordinate=Slider(20, range=-10..30), ZCoordinate=Slider(1, range=-10..30))
line_14 = Line(StartPoint=construct_point_25, EndPoint=construct_point_26)

# ---- group: Example of a line for testing
construct_point_27 = ConstructPoint(XCoordinate=Slider(5, range=-10..30), YCoordinate=Slider(1, range=-10..30), ZCoordinate=Slider(0, range=-10..30))
construct_point_28 = ConstructPoint(XCoordinate=Slider(30, range=-10..30), YCoordinate=Slider(1, range=-10..30), ZCoordinate=Slider(0, range=-10..30))
line_15 = Line(StartPoint=construct_point_27, EndPoint=construct_point_28)

# ----
# [TODO]: Implement the gcode generation algorithm in Python
# [TODO]: Initialize Input Parameters
# [TODO]: Use Pancake Plug-in to Export Gcode Output File as .gcode
# NOTE THAT THIS GCODE OUTPUT ASSUMES:
# - A PRUSA MK3S+ as the Printer
# - PLA Material
# - Extrusion Temperature: 215C
# - Heated Bed Temperature: 60C
# Optimized toolpath
num_layers_2 = Slider(5, range=1..10)
layer_height_4 = Slider(0.3, range=0..5)
multiplication_3 = Multiplication(A=num_layers_2, B=layer_height_4)
build_plate_mid_2 = Slider(105, range=0..1000)
cylinder_2 = Cylinder(Base=PlaneXY(0, 0, 0), Radius=10, Length=multiplication_3)
vector_xyz_3 = VectorXYZ(XComponent=build_plate_mid_2, YComponent=build_plate_mid_2, ZComponent=0)  # -> Vector, Length
cap_holes_2 = CapHoles(Brep=cylinder_2)
move_3 = Move(Geometry=cap_holes_2, Motion=vector_xyz_3.Vector)  # -> Geometry, Transform
layer_height_5 = Slider(0.3, range=0..1)
cylender_brep_2 = Brep(move_3.Geometry)
density_2 = Slider(1, range=0..1)
unit_z_2 = UnitZ(Factor=Slider(0.2, range=0..1))
contour_2 = Contour(Shape=cylender_brep_2, Point=unit_z_2, Direction=Vector(0, 0, 1), Distance=layer_height_5)
division = Division(A=Slider(1, range=0..1), B=density_2)
trim_tree_3 = TrimTree(Tree=simplify(graft(contour_2)), Depth=Slider(0, range=0..5))
discrete_length_2 = Panel("0.01")
nozzle_diam_2 = Panel("0.4")
extrusion_width_factor_2 = Panel("1.2")
number_2 = Number(num_layers_2)
density_3 = Number(density_2)
multiplication_4 = Multiplication(A=nozzle_diam_2, B=extrusion_width_factor_2)
multiplication_5 = Multiplication(A=division, B=multiplication_4)
expression_3 = Expression(
    NumLayers=number_2,
    Density=density_3,
    InfillType="Optimized2",
    Expression="\"/Users/a.../Desktop/Masters/Fall24/CSCI7000_ComFab/CSCI-7000-Computational-Fabrication/code/L3/output-\" & NumLayers & \"l_\"&Density &\"P_\" &InfillType &\"I.gcode\"")
layer_change_feed_rate_2 = Panel("720")
extrusion_feed_rate_2 = Panel("600")
travel_feed_rate_2 = Panel("1200")
filament_diam_2 = Panel("1.75")
layer_height_6 = Panel("0.3")
line_16 = Line([line_6, line_2])
true_only_button_2 = TrueOnlyButton(LastSaveLocalization="neutral,N")
panel_3 = Panel(expression_3)

# ----
# Basic infill
unit_x = UnitX(Factor=1)
contour_3 = Contour(Shape=contour_2, Point=Point(0, 0, 0.3), Direction=unit_x, Distance=multiplication_5)

# ----
# [TODO]: Implement the gcode generation algorithm in Python
# [TODO]: Initialize Input Parameters
# [TODO]: Use Pancake Plug-in to Export Gcode Output File as .gcode
# NOTE THAT THIS GCODE OUTPUT ASSUMES:
# - A PRUSA MK3S+ as the Printer
# - PLA Material
# - Extrusion Temperature: 215C
# - Heated Bed Temperature: 60C
# Concentric Infill
num_layers_3 = Slider(5, range=1..10)
layer_height_7 = Slider(0.3, range=0..5)
multiplication_6 = Multiplication(A=num_layers_3, B=layer_height_7)
build_plate_mid_3 = Slider(105, range=0..1000)
cylinder_3 = Cylinder(Base=PlaneXY(0, 0, 0), Radius=10, Length=multiplication_6)
vector_xyz_4 = VectorXYZ(XComponent=build_plate_mid_3, YComponent=build_plate_mid_3, ZComponent=0)  # -> Vector, Length
cap_holes_3 = CapHoles(Brep=cylinder_3)
move_4 = Move(Geometry=cap_holes_3, Motion=vector_xyz_4.Vector)  # -> Geometry, Transform
layer_height_8 = Slider(0.3, range=0..1)
cylender_brep_3 = Brep(move_4.Geometry)
density_4 = Slider(1, range=0..1)
unit_z_3 = UnitZ(Factor=Slider(0.2, range=0..1))
contour_4 = Contour(Shape=cylender_brep_3, Point=unit_z_3, Direction=Vector(0, 0, 1), Distance=layer_height_8)
division_2 = Division(A=Slider(1, range=0..1), B=density_4)
trim_tree_4 = TrimTree(Tree=simplify(graft(contour_4)), Depth=Slider(0, range=0..5))
discrete_length_3 = Panel("0.01")
nozzle_diam_3 = Panel("0.4")
extrusion_width_factor_3 = Panel("1.2")
number_3 = Number(num_layers_3)
density_5 = Number(density_4)
multiplication_7 = Multiplication(A=nozzle_diam_3, B=extrusion_width_factor_3)
multiplication_8 = Multiplication(A=division_2, B=multiplication_7)
expression_4 = Expression(
    NumLayers=number_3,
    Density=density_5,
    InfillType="Concentric",
    Expression="\"/Users/a.../Desktop/Masters/Fall24/CSCI7000_ComFab/CSCI-7000-Computational-Fabrication/code/L3/output-\" & NumLayers & \"l_\"&Density &\"P_\" &InfillType &\"I.gcode\"")
layer_change_feed_rate_3 = Panel("720")
extrusion_feed_rate_3 = Panel("600")
travel_feed_rate_3 = Panel("1200")
filament_diam_3 = Panel("1.75")
layer_height_9 = Panel("0.3")
line_17 = Line([line_7, line_3])
true_only_button_3 = TrueOnlyButton(LastSaveLocalization="neutral,N")
panel_4 = Panel(expression_4)

# ----
# Basic infill
unit_x_2 = UnitX(Factor=1)
contour_5 = Contour(Shape=contour_4, Point=Point(0, 0, 0.3), Direction=unit_x_2, Distance=multiplication_8)

# ----
# [TODO]: Create Test Cylinder and Move to center of Bed
# [TODO]: Implement the gcode generation algorithm in Python
# [TODO]: Initialize Input Parameters
# [TODO]: Use Pancake Plug-in to Export Gcode Output File as .gcode
# NOTE THAT THIS GCODE OUTPUT ASSUMES:
# - A PRUSA MK3S+ as the Printer
# - PLA Material
# - Extrusion Temperature: 215C
# - Heated Bed Temperature: 60C
# Basic Slicer
num_layers_4 = Slider(5, range=1..10)
layer_height_10 = Slider(0.3, range=0..5)
multiplication_9 = Multiplication(A=num_layers_4, B=layer_height_10)
build_plate_mid_4 = Slider(105, range=0..1000)
cylinder_4 = Cylinder(Base=PlaneXY(0, 0, 0), Radius=10, Length=multiplication_9)
vector_xyz_5 = VectorXYZ(XComponent=build_plate_mid_4, YComponent=build_plate_mid_4, ZComponent=0)  # -> Vector, Length
cap_holes_4 = CapHoles(Brep=cylinder_4)
move_5 = Move(Geometry=cap_holes_4, Motion=vector_xyz_5.Vector)  # -> Geometry, Transform
# [TODO]: Create Contours / Perimeters)
number_slider_2 = Slider(0.2, range=0..1)
layer_height_11 = Slider(0.3, range=0..1)
cylender_brep_4 = Brep(move_5.Geometry)
density_6 = Slider(1, range=0..1)
unit_z_4 = UnitZ(Factor=number_slider_2)
# [TODO]: Create Infill Patterns
contour_6 = Contour(Shape=cylender_brep_4, Point=unit_z_4, Direction=Vector(0, 0, 1), Distance=layer_height_11)
division_3 = Division(A=Slider(1, range=0..1), B=density_6)
# [TODO]: Combine Perimeters and Infill
trim_tree_5 = TrimTree(Tree=simplify(graft(contour_6)), Depth=Slider(0, range=0..5))
discrete_length_4 = Panel("0.01")
nozzle_diam_4 = Panel("0.4")
extrusion_width_factor_4 = Panel("1.2")
number_4 = Number(num_layers_4)
density_7 = Number(density_6)
multiplication_10 = Multiplication(A=nozzle_diam_4, B=extrusion_width_factor_4)
multiplication_11 = Multiplication(A=division_3, B=multiplication_10)
expression_5 = Expression(
    NumLayers=number_4,
    Density=density_7,
    InfillType="Basic",
    Expression="\"/Users/a.../Desktop/Masters/Fall24/CSCI7000_ComFab/CSCI-7000-Computational-Fabrication/code/L3/output-\" & NumLayers & \"l_\"&Density &\"P_\" &InfillType &\"I.gcode\"")
layer_change_feed_rate_4 = Panel("720")
extrusion_feed_rate_4 = Panel("600")
travel_feed_rate_4 = Panel("1200")
filament_diam_4 = Panel("1.75")
layer_height_12 = Panel("0.3")
line_18 = Line([line_5, line])
true_only_button_4 = TrueOnlyButton(LastSaveLocalization="neutral,N")
panel_5 = Panel(expression_5)

# ----
# Basic infill
unit_x_3 = UnitX(Factor=1)
contour_7 = Contour(Shape=contour_6, Point=Point(0, 0, 0.3), Direction=unit_x_3, Distance=multiplication_11)

trim_tree_6 = TrimTree(Tree=contour_7, Depth=Slider(2, range=0..5))
infill = Curve(trim_tree_6)
merge = Merge(Data1=trim_tree_5, Data2=simplify(infill))
# [TODO]: Create Line Segments from Perimeters and Infill
divide_length_2 = DivideLength(Curve=merge, Distance=discrete_length_4, RoundUp=False, RoundDn=False)
cull_duplicates_2 = CullDuplicates(Points=divide_length_2, Tolerance=0.1, CullMode=3)  # -> Points, Indices, Valence
polyline_2 = PolyLine(Vertices=cull_duplicates_2.Points, Closed=False)
simplify_curve_2 = SimplifyCurve(Curve=polyline_2)  # -> Curve, Simplified
explode_2 = Explode(Curve=simplify_curve_2.Curve, Recursive=True)  # -> flatten(Segments), Vertices
printing_lines_2 = Line(explode_2.Segments)
python_3_script_generate_gcode_2 = Python3Script(
    lines=flatten(printing_lines_2),
    nozzle_diameter=nozzle_diam_4,
    filament_diameter=filament_diam_4,
    layer_height=layer_height_12,
    extrusion_width=multiplication_10,
    travel_feed_rate=travel_feed_rate_4,
    layer_change_feed_rate=layer_change_feed_rate_4,
    extrusion_feed_rate=extrusion_feed_rate_4)  # -> out, gcode_output; inputs lines: list of Line, nozzle_diameter: Double, filament_diameter: Double, layer_height: Double, extrusion_width: Double, travel_feed_rate: Double, layer_change_feed_rate: Double, extrusion_feed_rate: Double; same code as python_3_script_generate_gcode
the_gcode_output_2 = Panel(python_3_script_generate_gcode_2.gcode_output)
debugging_panel_2 = Panel(python_3_script_generate_gcode_2.out)
export_txt_2 = ExportTXT(
    Content=python_3_script_generate_gcode_2.gcode_output,
    FileLocation=expression_5,
    Overwrite=Toggle(True),
    Encoding="utf-8",
    Export=true_only_button_4,
    LastSaveLocalization="neutral,N")
panel_6 = Panel(export_txt_2)

# ----
# [TODO]: Implement the gcode generation algorithm in Python
# [TODO]: Initialize Input Parameters
# [TODO]: Use Pancake Plug-in to Export Gcode Output File as .gcode
# NOTE THAT THIS GCODE OUTPUT ASSUMES:
# - A PRUSA MK3S+ as the Printer
# - PLA Material
# - Extrusion Temperature: 215C
# - Heated Bed Temperature: 60C
# Honeycomb infill
num_layers_5 = Slider(5, range=1..10)
layer_height_13 = Slider(0.3, range=0..5)
multiplication_12 = Multiplication(A=num_layers_5, B=layer_height_13)
build_plate_mid_5 = Slider(105, range=0..1000)
cylinder_5 = Cylinder(Base=PlaneXY(0, 0, 0), Radius=10, Length=multiplication_12)
vector_xyz_6 = VectorXYZ(XComponent=build_plate_mid_5, YComponent=build_plate_mid_5, ZComponent=0)  # -> Vector, Length
cap_holes_5 = CapHoles(Brep=cylinder_5)
move_6 = Move(Geometry=cap_holes_5, Motion=vector_xyz_6.Vector)  # -> Geometry, Transform
density_8 = Slider(0.25, range=0..1)
layer_height_14 = Slider(0.3, range=0..1)
cylender_brep_5 = Brep(move_6.Geometry)
unit_z_5 = UnitZ(Factor=Slider(0.2, range=0..1))
contour_8 = Contour(Shape=cylender_brep_5, Point=unit_z_5, Direction=Vector(0, 0, 1), Distance=layer_height_14)
division_4 = Division(A=Slider(1, range=0..1), B=density_8)
trim_tree_7 = TrimTree(Tree=simplify(graft(contour_8)), Depth=Slider(0, range=0..5))
discrete_length_5 = Panel("0.009")
nozzle_diam_5 = Panel("0.4")
extrusion_width_factor_5 = Panel("1.2")
number_5 = Number(num_layers_5)
density_9 = Number(density_8)
multiplication_13 = Multiplication(A=nozzle_diam_5, B=extrusion_width_factor_5)
multiplication_14 = Multiplication(A=division_4, B=multiplication_13)
expression_6 = Expression(
    NumLayers=number_5,
    Density=density_9,
    InfillType="Honeycomb",
    Expression="\"/Users/a.../Desktop/Masters/Fall24/CSCI7000_ComFab/CSCI-7000-Computational-Fabrication/code/L3/output-\" & NumLayers & \"l_\"&Density &\"P_\" &InfillType &\"I.gcode\"")
layer_change_feed_rate_5 = Panel("720")
extrusion_feed_rate_5 = Panel("600")
travel_feed_rate_5 = Panel("1200")
filament_diam_5 = Panel("1.75")
layer_height_15 = Panel("0.3")
line_19 = Line([line_9, line_4])
true_only_button_5 = TrueOnlyButton(LastSaveLocalization="neutral,N")
panel_7 = Panel(expression_6)

# ----
# Basic infill
unit_x_4 = UnitX(Factor=1)
contour_9 = Contour(Shape=contour_8, Point=Point(0, 0, 0.3), Direction=unit_x_4, Distance=multiplication_14)

# ----
# [TODO]: Implement the gcode generation algorithm in Python
# [TODO]: Initialize Input Parameters
# [TODO]: Use Pancake Plug-in to Export Gcode Output File as .gcode
# NOTE THAT THIS GCODE OUTPUT ASSUMES:
# - A PRUSA MK3S+ as the Printer
# - PLA Material
# - Extrusion Temperature: 215C
# - Heated Bed Temperature: 60C
# Hilbert Curve infill
num_layers_6 = Slider(5, range=1..10)
layer_height_16 = Slider(0.3, range=0..5)
multiplication_15 = Multiplication(A=num_layers_6, B=layer_height_16)
build_plate_mid_6 = Slider(105, range=0..1000)
cylinder_6 = Cylinder(Base=PlaneXY(0, 0, 0), Radius=10, Length=multiplication_15)
vector_xyz_7 = VectorXYZ(XComponent=build_plate_mid_6, YComponent=build_plate_mid_6, ZComponent=0)  # -> Vector, Length
cap_holes_6 = CapHoles(Brep=cylinder_6)
move_7 = Move(Geometry=cap_holes_6, Motion=vector_xyz_7.Vector)  # -> Geometry, Transform
layer_height_17 = Slider(0.3, range=0..1)
cylender_brep_6 = Brep(move_7.Geometry)
density_10 = Slider(0.3, range=0..1)
unit_z_6 = UnitZ(Factor=Slider(0.2, range=0..1))
contour_10 = Contour(Shape=cylender_brep_6, Point=unit_z_6, Direction=Vector(0, 0, 1), Distance=layer_height_17)
division_5 = Division(A=Slider(1, range=0..1), B=density_10)
trim_tree_8 = TrimTree(Tree=simplify(graft(contour_10)), Depth=Slider(0, range=0..5))
discrete_length_6 = Panel("0.001")
nozzle_diam_6 = Panel("0.4")
extrusion_width_factor_6 = Panel("1.2")
density_11 = Number(density_10)
number_6 = Number(num_layers_6)
multiplication_16 = Multiplication(A=nozzle_diam_6, B=extrusion_width_factor_6)
multiplication_17 = Multiplication(A=division_5, B=multiplication_16)
expression_7 = Expression(
    NumLayers=number_6,
    Density=density_11,
    InfillType="HilbertCurve",
    Expression="\"/Users/a.../Desktop/Masters/Fall24/CSCI7000_ComFab/CSCI-7000-Computational-Fabrication/code/L3/output-\" & NumLayers & \"l_\"&Density &\"P_\" &InfillType &\"I.gcode\"")
layer_change_feed_rate_6 = Panel("720")
extrusion_feed_rate_6 = Panel("600")
travel_feed_rate_6 = Panel("1200")
filament_diam_6 = Panel("1.75")
layer_height_18 = Panel("0.3")
line_20 = Line([line_13, line_10])
true_only_button_6 = TrueOnlyButton(LastSaveLocalization="neutral,N")
panel_8 = Panel(expression_7)

# ----
# Hilbert curve
boundary_surfaces = BoundarySurfaces(Edges=contour_10)
deconstruct_box = DeconstructBox(Box=boundary_surfaces)  # -> Plane, X, Y, Z
deconstruct_domain = DeconstructDomain(Domain=deconstruct_box.Z)  # -> Start, End
deconstruct_domain_2 = DeconstructDomain(Domain=deconstruct_box.X)  # -> Start, End
deconstruct_domain_3 = DeconstructDomain(Domain=deconstruct_box.Y)  # -> Start, End
python_3_script = Python3Script(
    stepSize=multiplication_17,
    startX=flatten(deconstruct_domain_2.Start),
    endX=flatten(deconstruct_domain_2.End),
    startY=flatten(deconstruct_domain_3.Start),
    endY=flatten(deconstruct_domain_3.End),
    Z=flatten(deconstruct_domain.End))  # -> out, hilbert_pts, hilbert_lines
# ---------- python_3_script: Python ----------
"""Grasshopper Script"""

import math 
import rhinoscriptsyntax as rs


def forward(x,y,d, s):
    if d == 0: # UP
        y += s
    elif d == 1: # right
        x+=s
    elif d ==2: # down
        y-=s
    elif d==3:# left    
        x-=s
    return x,y

def hilbertCurve():
    s = stepSize
    # print(stepSize)
    h = abs(startY-endY)
    w = abs(startX-endX)
    origin = [min(startX,endX), min(startY,endY), Z]
    
    windowSize = max(h,w)
    order = math.ceil(math.log2(windowSize/s + 1))
    # s = windowSize/((2**order)-1)
    print(windowSize, s, order )
    direction = 0 #[0,1,2,3] # Up, Right, Down, Left. 

    # Alphabet : A, B
    # Constants : F + −
    axiom  = "A"
    rules= [["A","+bF-aFa-Fb+"],["B","-aF+bFb+Fa-"]]
    string = axiom
    px,py, pz = origin[0], origin[1], Z
    cx,cy, cz =  px,py, pz
    for i in range(order):
        # print("i: ", i)
        for rule in rules:
            # print("rule", rule)
            # print('string: ', string)
            string = string.replace(rule[0],rule[1])
        string = string.replace('a','A')
        string = string.replace('b','B')
            # string.replace('A', 'B')
            # print('string: ', string)

    pts = []
    lines = []
    
    rh_pt = rs.AddPoint(origin)
    pts.append(rh_pt)
    # print("string : ", string)
    for c in string:
        # print("c: ", c )
        if c == 'F': # forward
            cx,cy = forward(cx,cy,direction, s)
            # print("x,y,d")
            cp = [cx,cy,cz]
            rh_pt = rs.AddPoint(cp)
            rh_line = rs.AddLine([px,py,pz], cp)
            px,py,pz = cp[0], cp[1], cp[2]
            pts.append(rh_pt)
            lines.append(rh_line)
        elif c== '+': # right
            direction = (direction+1)%4
        elif c == '-': # left 
            direction = (direction-1)%4
    # print("pts: ",pts)
    # print(lines)
    return pts, lines

hilbert_pts, hilbert_lines = hilbertCurve()
# print("hliness", hilbert_lines)


# def generate_points():
#     x_pos = 0
#     y_pos = 0
#     pts = []
#     for i in range(0, num_peaks):
#         z_pos = 0
#         base_rad = 2 * math.pi / (2 * points_per_peak)
#         for j in range(0, 2 * points_per_peak):
#             # z = r * sin(rads)
#             z_pos = peak_radius * math.sin(j * base_rad)
#             pt = [x_pos, y_pos, z_pos]
#             rh_pt = rs.AddPoint(pt)
#             pts.append(rh_pt)
#             x_pos += x_spacing
#     return pts

# output_pts = generate_points()
# ---------- end python_3_script ----------
surface_curve = SurfaceCurve(Surface=boundary_surfaces, Curve=python_3_script.hilbert_lines)  # -> Curves, Points, UVPoints, Normals, Parameters, Tangents
clean_tree = CleanTree(RemoveNulls=True, RemoveInvalid=True, RemoveEmpty=True, Tree=surface_curve.Curves)
trim_tree_9 = TrimTree(Tree=clean_tree, Depth=1)
infill_2 = Curve(trim_tree_9)

# ----
# Basic infill
unit_x_5 = UnitX(Factor=1)
contour_11 = Contour(Shape=contour_10, Point=Point(0, 0, 0.3), Direction=unit_x_5, Distance=multiplication_17)

trim_tree_10 = TrimTree(Tree=contour_11, Depth=Slider(2, range=0..5))
infill_3 = Curve(trim_tree_9)
merge_2 = Merge(Data1=trim_tree_8, Data2=simplify(infill_3))
divide_length_3 = DivideLength(Curve=merge_2, Distance=discrete_length_6, RoundUp=True, RoundDn=False)
cull_duplicates_3 = CullDuplicates(Points=divide_length_3, Tolerance=0.1, CullMode=3)  # -> Points, Indices, Valence
polyline_3 = PolyLine(Vertices=cull_duplicates_3.Points, Closed=False)
simplify_curve_3 = SimplifyCurve(Curve=polyline_3)  # -> Curve, Simplified
explode_3 = Explode(Curve=simplify_curve_3.Curve, Recursive=True)  # -> flatten(Segments), Vertices
printing_lines_3 = Line(explode_3.Segments)
python_3_script_generate_gcode_3 = Python3Script(
    lines=flatten(printing_lines_3),
    nozzle_diameter=nozzle_diam_6,
    filament_diameter=filament_diam_6,
    layer_height=layer_height_18,
    extrusion_width=multiplication_16,
    travel_feed_rate=travel_feed_rate_6,
    layer_change_feed_rate=layer_change_feed_rate_6,
    extrusion_feed_rate=extrusion_feed_rate_6)  # -> out, gcode_output; inputs lines: list of Line, nozzle_diameter: Double, filament_diameter: Double, layer_height: Double, extrusion_width: Double, travel_feed_rate: Double, layer_change_feed_rate: Double, extrusion_feed_rate: Double; same code as python_3_script_generate_gcode
the_gcode_output_3 = Panel(python_3_script_generate_gcode_3.gcode_output)
debugging_panel_3 = Panel(python_3_script_generate_gcode_3.out)
export_txt_3 = ExportTXT(
    Content=python_3_script_generate_gcode_3.gcode_output,
    FileLocation=expression_7,
    Overwrite=Toggle(True),
    Encoding="utf-8",
    Export=true_only_button_6,
    LastSaveLocalization="neutral,N")
panel_9 = Panel(export_txt_3)

# ----
# [TODO]: Implement the gcode generation algorithm in Python
# [TODO]: Initialize Input Parameters
# [TODO]: Use Pancake Plug-in to Export Gcode Output File as .gcode
# NOTE THAT THIS GCODE OUTPUT ASSUMES:
# - A PRUSA MK3S+ as the Printer
# - PLA Material
# - Extrusion Temperature: 215C
# - Heated Bed Temperature: 60C
# First Everything draft
num_layers_7 = Slider(5, range=1..10)
layer_height_19 = Slider(0.3, range=0..5)
multiplication_18 = Multiplication(A=num_layers_7, B=layer_height_19)
build_plate_mid_7 = Slider(105, range=0..1000)
cylinder_7 = Cylinder(Base=PlaneXY(0, 0, 0), Radius=10, Length=multiplication_18)
vector_xyz_8 = VectorXYZ(XComponent=build_plate_mid_7, YComponent=build_plate_mid_7, ZComponent=0)  # -> Vector, Length
cap_holes_7 = CapHoles(Brep=cylinder_7)
move_8 = Move(Geometry=cap_holes_7, Motion=vector_xyz_8.Vector)  # -> Geometry, Transform
layer_height_20 = Slider(0.3, range=0..1)
cylender_brep_7 = Brep(move_8.Geometry)
density_12 = Slider(1, range=0..1)
unit_z_7 = UnitZ(Factor=Slider(0.2, range=0..1))
contour_12 = Contour(Shape=cylender_brep_7, Point=unit_z_7, Direction=Vector(0, 0, 1), Distance=layer_height_20)
boundary_surfaces_2 = BoundarySurfaces(Edges=contour_12)
deconstruct_box_2 = DeconstructBox(Box=boundary_surfaces_2)  # -> Plane, X, Y, Z
deconstruct_domain_4 = DeconstructDomain(Domain=deconstruct_box_2.X)  # -> Start, End
deconstruct_domain_5 = DeconstructDomain(Domain=deconstruct_box_2.Y)  # -> Start, End
division_6 = Division(A=Slider(1, range=0..1), B=density_12)
subtraction = Subtraction()
series = Series(Start=deconstruct_domain_5.Start, Step=1, Count=deconstruct_domain_5.End)
trim_tree_11 = TrimTree(Tree=simplify(graft(contour_12)), Depth=Slider(0, range=0..5))
discrete_length_7 = Panel("0.01")
nozzle_diam_7 = Panel("0.4")
extrusion_width_factor_7 = Panel("1.2")
density_13 = Number(density_12)
multiplication_19 = Multiplication(A=nozzle_diam_7, B=extrusion_width_factor_7)
multiplication_20 = Multiplication(A=division_6, B=multiplication_19)
layer_change_feed_rate_7 = Panel("720")
extrusion_feed_rate_7 = Panel("600")
travel_feed_rate_7 = Panel("1200")
filament_diam_7 = Panel("1.75")
layer_height_21 = Panel("0.3")
line_21 = Line([line_15, line_14])
number_7 = Number(num_layers_7)
expression_8 = Expression(
    NumLayers=number_7,
    Density=density_13,
    InfillType="Honeycomb",
    Expression="\"/Users/a.../Desktop/Masters/Fall24/CSCI7000_ComFab/CSCI-7000-Computational-Fabrication/code/L3/output-\" & NumLayers & \"l_\"&Density &\"P_\" &InfillType &\"I.gcode\"")
true_only_button_7 = TrueOnlyButton(LastSaveLocalization="neutral,N")
panel_10 = Panel(expression_8)

# ----
# Basic infill
unit_x_6 = UnitX(Factor=1)
contour_13 = Contour(Shape=contour_12, Point=Point(0, 0, 0.3), Direction=unit_x_6, Distance=multiplication_20)

# ----
# Create concentric infill (Method #1, kind of works)
area = Area(Geometry=graft(trim_tree_11))  # -> Area, Centroid
unit_x_7 = UnitX(Factor=1)
dimensions = Dimensions(Surface=boundary_surfaces_2)  # -> UDimension, VDimension
division_7 = Division(A=dimensions.UDimension, B=2)

# ----
# Honeycomb infill
boundary_surfaces_3 = BoundarySurfaces(Edges=contour_8)
dimensions_2 = Dimensions(Surface=boundary_surfaces_3)  # -> UDimension, VDimension
infill_spacing = Number(multiplication_14)
expression_9 = Expression(x=infill_spacing, Expression="x/(sqrt(3)) +1 ")
division_8 = Division(A=dimensions_2.UDimension, B=-2)
division_9 = Division(A=dimensions_2.VDimension, B=-2)
boundry_contour = Curve(trim_tree_7)
unit_x_8 = UnitX(Factor=division_8)
unit_y = UnitY(Factor=division_9)
addition = Addition(A=unit_x_8, B=unit_y)
boundary_surfaces_4 = BoundarySurfaces(Edges=boundry_contour)

# ----
# Create concentric infill (Method #1, kind of works)
boundary_surfaces_5 = BoundarySurfaces(Edges=contour_4)
area_2 = Area(Geometry=graft(trim_tree_4))  # -> Area, Centroid
unit_x_9 = UnitX(Factor=1)
dimensions_3 = Dimensions(Surface=boundary_surfaces_5)  # -> UDimension, VDimension
division_10 = Division(A=dimensions_3.UDimension, B=2)

trim_tree_12 = TrimTree(Tree=contour_9, Depth=Slider(2, range=0..5))

list_length_2 = ListLength(InfillLinesList=trim_tree_12)
number_of_filling_contours = Number(list_length_2)
expression_10 = Expression(x=number_of_filling_contours, Expression="x*(sqrt(3) )*2/3 + 1")
addition_2 = Addition(A=number_of_filling_contours, B=1)
hexagonal = Hexagonal(Plane=boundry_contour, Size=expression_9, ExtentX=expression_10, ExtentY=addition_2)  # -> Cells, Points
move_9 = Move(Geometry=simplify(hexagonal.Cells), Motion=addition)  # -> Geometry, Transform
trim_tree_13 = TrimTree(Tree=move_9.Geometry, Depth=1)
surface_curve_2 = SurfaceCurve(Surface=boundary_surfaces_4, Curve=trim_tree_13)  # -> Curves, Points, UVPoints, Normals, Parameters, Tangents
clean_tree_2 = CleanTree(RemoveNulls=True, RemoveInvalid=True, RemoveEmpty=True, Tree=surface_curve_2.Curves)
trim_tree_14 = TrimTree(Tree=clean_tree_2, Depth=1)
infill_4 = Geometry(trim_tree_14)

infill_5 = Curve(infill_4)
merge_3 = Merge(Data1=trim_tree_7, Data2=infill_5)
curve = Curve(merge_3)
divide_length_4 = DivideLength(Curve=curve, Distance=discrete_length_5, RoundUp=True, RoundDn=False)
cull_duplicates_4 = CullDuplicates(Points=divide_length_4, Tolerance=0.1, CullMode=3)  # -> Points, Indices, Valence
polyline_4 = PolyLine(Vertices=cull_duplicates_4.Points, Closed=False)
simplify_curve_4 = SimplifyCurve(Curve=polyline_4)  # -> Curve, Simplified
explode_4 = Explode(Curve=simplify_curve_4.Curve, Recursive=True)  # -> flatten(Segments), Vertices
printing_lines_4 = Line(explode_4.Segments)
python_3_script_generate_gcode_4 = Python3Script(
    lines=flatten(printing_lines_4),
    nozzle_diameter=nozzle_diam_5,
    filament_diameter=filament_diam_5,
    layer_height=layer_height_15,
    extrusion_width=multiplication_13,
    travel_feed_rate=travel_feed_rate_5,
    layer_change_feed_rate=layer_change_feed_rate_5,
    extrusion_feed_rate=extrusion_feed_rate_5)  # -> out, gcode_output; inputs lines: list of Line, nozzle_diameter: Double, filament_diameter: Double, layer_height: Double, extrusion_width: Double, travel_feed_rate: Double, layer_change_feed_rate: Double, extrusion_feed_rate: Double; same code as python_3_script_generate_gcode
the_gcode_output_4 = Panel(python_3_script_generate_gcode_4.gcode_output)
debugging_panel_4 = Panel(python_3_script_generate_gcode_4.out)
export_txt_4 = ExportTXT(
    Content=python_3_script_generate_gcode_4.gcode_output,
    FileLocation=expression_6,
    Overwrite=Toggle(True),
    Encoding="utf-8",
    Export=true_only_button_5,
    LastSaveLocalization="neutral,N")
panel_11 = Panel(export_txt_4)

# ----
# Create Concentric fill #2
boundry_contour_2 = Curve(trim_tree_4)
negative = Negative(InfillSpacing=multiplication_8)

trim_tree_15 = TrimTree(Tree=contour_3, Depth=Slider(2, range=0..5))

# ----
# Optimizing toolpath by flipping  alternating curves
filling_contours = Curve(trim_tree_15)
dispatch = Dispatch(List=filling_contours, DispatchPattern=[True, False])  # -> ListA, ListB
flip_curve = FlipCurve(Curve=dispatch.ListB)  # -> Curve, Flag
weave = Weave(Pattern=[0, 1], Stream0=dispatch.ListA, Stream1=flip_curve.Curve, NullGaps=False)

connect_curves = ConnectCurves(Curves=weave, Continuity=0, Close=False, Bulge=1)

reverse_list = ReverseList(List=connect_curves)

infill_6 = Curve(reverse_list)
merge_4 = Merge(Data1=trim_tree_3, Data2=simplify(infill_6))
divide_length_5 = DivideLength(Curve=merge_4, Distance=discrete_length_2, RoundUp=False, RoundDn=False)
cull_duplicates_5 = CullDuplicates(Points=divide_length_5, Tolerance=0.1, CullMode=3)  # -> Points, Indices, Valence
polyline_5 = PolyLine(Vertices=cull_duplicates_5.Points, Closed=False)
simplify_curve_5 = SimplifyCurve(Curve=polyline_5)  # -> Curve, Simplified
explode_5 = Explode(Curve=simplify_curve_5.Curve, Recursive=True)  # -> flatten(Segments), Vertices
printing_lines_5 = Line(explode_5.Segments)
python_3_script_generate_gcode_5 = Python3Script(
    lines=flatten(printing_lines_5),
    nozzle_diameter=nozzle_diam_2,
    filament_diameter=filament_diam_2,
    layer_height=layer_height_6,
    extrusion_width=multiplication_4,
    travel_feed_rate=travel_feed_rate_2,
    layer_change_feed_rate=layer_change_feed_rate_2,
    extrusion_feed_rate=extrusion_feed_rate_2)  # -> out, gcode_output; inputs lines: list of Line, nozzle_diameter: Double, filament_diameter: Double, layer_height: Double, extrusion_width: Double, travel_feed_rate: Double, layer_change_feed_rate: Double, extrusion_feed_rate: Double; same code as python_3_script_generate_gcode
the_gcode_output_5 = Panel(python_3_script_generate_gcode_5.gcode_output)
debugging_panel_5 = Panel(python_3_script_generate_gcode_5.out)
export_txt_5 = ExportTXT(
    Content=python_3_script_generate_gcode_5.gcode_output,
    FileLocation=expression_3,
    Overwrite=Toggle(True),
    Encoding="utf-8",
    Export=true_only_button_2,
    LastSaveLocalization="neutral,N")
panel_12 = Panel(export_txt_5)

trim_tree_16 = TrimTree(Tree=contour_5, Depth=Slider(2, range=0..5))

project_point = ProjectPoint(Point=area_2.Centroid, Direction=unit_x_9, Geometry=graft(trim_tree_16))  # -> Point, Index
distance = Distance(PointA=area_2.Centroid, PointB=graft(project_point.Point))
division_11 = Division(A=distance, B=division_10)
scale = Scale(Geometry=graft(trim_tree_4), Center=area_2.Centroid, Factor=division_11)  # -> Geometry, Transform

list_length_3 = ListLength(InfillLinesList=trim_tree_16)
integer_division = IntegerDivision(A=list_length_3, B=2)
series_2 = Series(Start=negative, Step=negative, Count=integer_division)
offset_curve = OffsetCurve(Curve=boundry_contour_2, Distance=simplify(series_2), Corners=1)

infill_7 = Curve(offset_curve)
merge_5 = Merge(Data1=trim_tree_4, Data2=simplify(infill_7))
divide_length_6 = DivideLength(Curve=merge_5, Distance=discrete_length_3, RoundUp=False, RoundDn=False)
cull_duplicates_6 = CullDuplicates(Points=divide_length_6, Tolerance=0.1, CullMode=3)  # -> Points, Indices, Valence
polyline_6 = PolyLine(Vertices=cull_duplicates_6.Points, Closed=False)
simplify_curve_6 = SimplifyCurve(Curve=polyline_6)  # -> Curve, Simplified
explode_6 = Explode(Curve=simplify_curve_6.Curve, Recursive=True)  # -> flatten(Segments), Vertices
printing_lines_6 = Line(explode_6.Segments)
python_3_script_generate_gcode_6 = Python3Script(
    lines=flatten(printing_lines_6),
    nozzle_diameter=nozzle_diam_3,
    filament_diameter=filament_diam_3,
    layer_height=layer_height_9,
    extrusion_width=multiplication_7,
    travel_feed_rate=travel_feed_rate_3,
    layer_change_feed_rate=layer_change_feed_rate_3,
    extrusion_feed_rate=extrusion_feed_rate_3)  # -> out, gcode_output; inputs lines: list of Line, nozzle_diameter: Double, filament_diameter: Double, layer_height: Double, extrusion_width: Double, travel_feed_rate: Double, layer_change_feed_rate: Double, extrusion_feed_rate: Double; same code as python_3_script_generate_gcode
the_gcode_output_6 = Panel(python_3_script_generate_gcode_6.gcode_output)
debugging_panel_6 = Panel(python_3_script_generate_gcode_6.out)
export_txt_6 = ExportTXT(
    Content=python_3_script_generate_gcode_6.gcode_output,
    FileLocation=expression_4,
    Overwrite=Toggle(True),
    Encoding="utf-8",
    Export=true_only_button_3,
    LastSaveLocalization="neutral,N")
panel_13 = Panel(export_txt_6)

trim_tree_17 = TrimTree(Tree=contour_13, Depth=Slider(2, range=0..5))

project_point_2 = ProjectPoint(Point=area.Centroid, Direction=unit_x_7, Geometry=graft(trim_tree_17))  # -> Point, Index
distance_2 = Distance(PointA=area.Centroid, PointB=graft(project_point_2.Point))
division_12 = Division(A=distance_2, B=division_7)
scale_2 = Scale(Geometry=graft(trim_tree_11), Center=area.Centroid, Factor=division_12)  # -> Geometry, Transform

# ----
# Optimizing toolpath by flipping  alternating curves
filling_contours_2 = Curve(trim_tree_17)
dispatch_2 = Dispatch(List=filling_contours_2, DispatchPattern=[True, False])  # -> ListA, ListB
flip_curve_2 = FlipCurve(Curve=dispatch_2.ListB)  # -> Curve, Flag
weave_2 = Weave(Pattern=[0, 1], Stream0=dispatch_2.ListA, Stream1=flip_curve_2.Curve, NullGaps=False)
reverse_list_2 = ReverseList(List=weave_2)

# ----
# Create Concentric fill #2
list_length_4 = ListLength(InfillLinesList=trim_tree_17)
boundry_contour_3 = Curve(trim_tree_11)
negative_2 = Negative(InfillSpacing=multiplication_20)
integer_division_2 = IntegerDivision(A=list_length_4, B=2)
series_3 = Series(Start=negative_2, Step=negative_2, Count=integer_division_2)
offset_curve_2 = OffsetCurve(Curve=boundry_contour_3, Distance=simplify(series_3), Corners=1)

# ----
# Honeycomb infill
dimensions_4 = Dimensions(Surface=boundary_surfaces_2)  # -> UDimension, VDimension
number_of_filling_contours_2 = Number(list_length_4)
infill_spacing_2 = Number(multiplication_20)
expression_11 = Expression(x=infill_spacing_2, Expression="x/(sqrt(3))")
expression_12 = Expression(x=number_of_filling_contours_2, Expression="x*(sqrt(3) )*2/3 + 1")
division_13 = Division(A=dimensions_4.UDimension, B=-2)
division_14 = Division(A=dimensions_4.VDimension, B=-2)
boundry_contour_4 = Curve(trim_tree_11)
unit_x_10 = UnitX(Factor=division_13)
unit_y_2 = UnitY(Factor=division_14)
hexagonal_2 = Hexagonal(Plane=boundry_contour_4, Size=expression_11, ExtentX=expression_12, ExtentY=number_of_filling_contours_2)  # -> Cells, Points
addition_3 = Addition(A=unit_x_10, B=unit_y_2)
move_10 = Move(Geometry=hexagonal_2.Cells, Motion=addition_3)  # -> Geometry, Transform

boundary_surfaces_6 = BoundarySurfaces(Edges=boundry_contour_4)
surface_curve_3 = SurfaceCurve(Surface=boundary_surfaces_6, Curve=move_10.Geometry)  # -> Curves, Points, UVPoints, Normals, Parameters, Tangents

geometry = Geometry(surface_curve_3.Curves)

infill_8 = Curve(geometry)
merge_6 = Merge(Data1=trim_tree_11, Data2=simplify(infill_8))
divide_length_7 = DivideLength(Curve=merge_6, Distance=discrete_length_7, RoundUp=False, RoundDn=False)
cull_duplicates_7 = CullDuplicates(Points=divide_length_7, Tolerance=0.1, CullMode=3)  # -> Points, Indices, Valence
polyline_7 = PolyLine(Vertices=cull_duplicates_7.Points, Closed=False)
simplify_curve_7 = SimplifyCurve(Curve=polyline_7)  # -> Curve, Simplified
explode_7 = Explode(Curve=simplify_curve_7.Curve, Recursive=True)  # -> flatten(Segments), Vertices
printing_lines_7 = Line(explode_7.Segments)
python_3_script_generate_gcode_7 = Python3Script(
    lines=flatten(printing_lines_7),
    nozzle_diameter=nozzle_diam_7,
    filament_diameter=filament_diam_7,
    layer_height=layer_height_21,
    extrusion_width=multiplication_19,
    travel_feed_rate=travel_feed_rate_7,
    layer_change_feed_rate=layer_change_feed_rate_7,
    extrusion_feed_rate=extrusion_feed_rate_7)  # -> out, gcode_output; inputs lines: list of Line, nozzle_diameter: Double, filament_diameter: Double, layer_height: Double, extrusion_width: Double, travel_feed_rate: Double, layer_change_feed_rate: Double, extrusion_feed_rate: Double; same code as python_3_script_generate_gcode
the_gcode_output_7 = Panel(python_3_script_generate_gcode_7.gcode_output)
debugging_panel_7 = Panel(python_3_script_generate_gcode_7.out)
export_txt_7 = ExportTXT(
    Content=python_3_script_generate_gcode_7.gcode_output,
    FileLocation=expression_8,
    Overwrite=Toggle(True),
    Encoding="utf-8",
    Export=true_only_button_7,
    LastSaveLocalization="neutral,N")
panel_14 = Panel(export_txt_7)
