# Grasshopper definition M3_furniture.gh (Grasshopper 1.0.8)

construct_point = ConstructPoint(XCoordinate=-60, YCoordinate=-60, ZCoordinate=-60)
construct_point_2 = ConstructPoint(XCoordinate=60, YCoordinate=60, ZCoordinate=60)
box_2pt = Box2Pt(PointA=construct_point_2, PointB=construct_point, Plane=PlaneXY(0, 0, 0))

# ----
# Locket frame
ellipsoid_base_radius = Slider(40, range=0..100)
ellipsoid_x = Slider(0.74, range=0..1)
ellipsoid_z = Slider(0.07, range=0..1)
thickness = Slider(2.507, range=0..5)
ellipsoid_y = Slider(0.51, range=0..1)
sphere = Sphere(Base=PlaneXY(0, 0, 0), Radius=ellipsoid_base_radius)
scale_nu = ScaleNU(Geometry=sphere, Plane=PlaneXY(0, 0, 0), ScaleX=ellipsoid_x, ScaleY=ellipsoid_y, ScaleZ=ellipsoid_z)  # -> Geometry, Transform
offset_surface = OffsetSurface(Surface=scale_nu.Geometry, Distance=thickness, Retrim=True)
brep_plane = BrepPlane(Brep=offset_surface, Plane=PlaneXY(0, 0, 0))  # -> Curves, Points
boundary_surfaces = BoundarySurfaces(Edges=brep_plane.Curves)
split_brep = SplitBrep(Brep=offset_surface, Cutter=boundary_surfaces)
split_brep_2 = SplitBrep(Brep=scale_nu.Geometry, Cutter=boundary_surfaces)
cap_holes = CapHoles(Brep=split_brep)
cap_holes_2 = CapHoles(Brep=split_brep_2)
solid_difference = SolidDifference(BrepsA=cap_holes, BrepsB=cap_holes_2)

# ----
# Create hinge parts
hingedisplacement = Slider(0.5, range=0..1)
multiplication = Multiplication(A=ellipsoid_base_radius, B=ellipsoid_y)
multiplication_2 = Multiplication(A=thickness, B=hingedisplacement)
addition = Addition(A=multiplication_2, B=multiplication)
ellipsoid_cutting_hinge = Slider(1, range=0..5)
construct_point_3 = ConstructPoint(XCoordinate=0, YCoordinate=addition, ZCoordinate=0)
offset_surface_2 = OffsetSurface(Surface=offset_surface, Distance=ellipsoid_cutting_hinge, Retrim=True)
yz_plane = YZPlane(Origin=construct_point_3)
cylinder = Cylinder(Base=yz_plane, Radius=multiplication_2, Length=ellipsoid_base_radius)
mirror = Mirror(Geometry=cylinder, Plane=PlaneYZ(0, 0, 0))  # -> Geometry, Transform
cylinder_2 = Cylinder(Base=yz_plane, Radius=multiplication_2, Length=Slider(2.24, range=0..5))
merge = Merge(Data1=cylinder, Data2=mirror.Geometry)
mirror_2 = Mirror(Geometry=cylinder_2, Plane=PlaneYZ(0, 0, 0))  # -> Geometry, Transform
solid_difference_2 = SolidDifference(BrepsA=merge, BrepsB=offset_surface_2)
middle_hinge = Relay([mirror_2.Geometry, cylinder_2])
solid_difference_3 = SolidDifference(BrepsA=merge, BrepsB=solid_difference_2)
cap_holes_3 = CapHoles(Brep=middle_hinge)
cap_holes_4 = CapHoles(Brep=solid_difference_3)
solid_difference_4 = SolidDifference(BrepsA=solid_difference_3, BrepsB=middle_hinge)
cap_holes_5 = CapHoles(Brep=solid_difference_4)
partition_list = PartitionList(List=[cap_holes_5, cap_holes_3], Size=Slider(2, range=0..10))
simplify_tree = SimplifyTree(Tree=partition_list, Front=False)
solid_union = SolidUnion(Breps=simplify(simplify_tree))

# ----
# Connect hinge and lokect parts
brep = Brep(solid_difference)
item_index = ItemIndex(List=brep, Item=brep)
reverse_list = ReverseList(List=brep)
pi = Pi(Factor=1)
list_item = ListItem(List=reverse_list, Index=1, Wrap=True)
multiplication_3 = Multiplication(A=item_index, B=pi)
rotate_3d = Rotate3D(Geometry=reverse_list, Angle=multiplication_3, Center=construct_point_3, Axis=Vector(1, 0, 0))  # -> Geometry, Transform
xz_plane = XZPlane(Origin=construct_point_3)
brep_plane_2 = BrepPlane(Brep=rotate_3d.Geometry, Plane=xz_plane)  # -> Curves, Points
boundary_surfaces_2 = BoundarySurfaces(Edges=brep_plane_2.Curves)
split_brep_3 = SplitBrep(Brep=rotate_3d.Geometry, Cutter=boundary_surfaces_2)
cap_holes_6 = CapHoles(Brep=simplify(flatten(split_brep_3)))
sub_list = SubList(List=cap_holes_6, Domain=Domain(3, 4), Wrap=True)  # -> List, Index
flatten_tree = FlattenTree(Tree=sub_list.List, Path="{0}")
split_list = SplitList(List=flatten_tree, Index=Slider(1, range=0..10))  # -> ListA, ListB
path_mapper = PathMapper(split_list.ListA, source="{0;0}", target="{0;1}")
merge_2 = Merge(Data1=path_mapper, Data2=split_list.ListB)
path_mapper_2 = PathMapper(merge_2, source="{0;path_index}", target="{path_index}")
merge_3 = Merge(Data1=path_mapper_2, Data2=solid_union)
solid_union_2 = SolidUnion(Breps=merge_3)

table_flat_y_location = Slider(0.67, range=0..1)

# ----
# Flattening table top
expression = Expression(a=ellipsoid_base_radius, b=ellipsoid_z, c=table_flat_y_location, Expression="a*b*c")
tree_item = TreeItem(Tree=solid_union_2, Path=Slider(1, range=0..100), Index=0, Wrap=True)
addition_2 = Addition(A=expression, B=thickness)
negative = Negative(Value=addition_2)
unit_z = UnitZ(Factor=negative)
xy_plane = XYPlane(Origin=unit_z)
brep_plane_3 = BrepPlane(Brep=tree_item, Plane=xy_plane)  # -> Curves, Points
boundary_surfaces_3 = BoundarySurfaces(Edges=brep_plane_3.Curves)
split_brep_4 = SplitBrep(Brep=tree_item, Cutter=boundary_surfaces_3)
list_item_2 = ListItem(List=split_brep_4, Index=0, Wrap=True)
cap_holes_7 = CapHoles(Brep=list_item_2)

# ----
# Add legs to lower side
leg_height = Slider(-5, range=-60..0)
tree_item_2 = TreeItem(Tree=solid_union_2, Path=Slider(0, range=0..100), Index=0, Wrap=True)
addition_3 = Addition(A=leg_height, B=negative)
unit_z_2 = UnitZ(Factor=addition_3)
leg_width = Slider(35, range=10..60)
leg_length = Slider(24, range=10..60)
xy_plane_2 = XYPlane(Origin=unit_z_2)
unit_y = UnitY(Factor=leg_length)
unit_x = UnitX(Factor=leg_width)
rectangle = Rectangle(Plane=xy_plane_2, XSize=leg_width, YSize=leg_length, Radius=0)  # -> Rectangle, Length
number_slider = Slider(1, range=0..12)
addition_4 = Addition(A=unit_x, B=unit_y)
negative_2 = Negative(Value=addition_4)
leg_height_up = Slider(7, range=0..60)
multiplication_4 = Multiplication(A=0.5, B=negative_2)
move = Move(Geometry=rectangle.Rectangle, Motion=multiplication_4)  # -> Geometry, Transform
lower_leg_r = Slider(5, range=0..15)
legtop_legbase = Slider(1, range=0..1)
unit_z_3 = UnitZ(Factor=leg_height_up)
divide_surface = DivideSurface(Surface=move.Geometry, UCount=number_slider, VCount=number_slider)  # -> Points, Normals, Parameters
area = Area(Geometry=move.Geometry)  # -> Area, Centroid
circle = Circle(Plane=divide_surface.Points, Radius=lower_leg_r)
scale = Scale(Geometry=move.Geometry, Center=area.Centroid, Factor=legtop_legbase)  # -> Geometry, Transform
move_2 = Move(Geometry=scale.Geometry, Motion=unit_z_3)  # -> Geometry, Transform
upper_leg_r = Slider(3, range=0..15)
circle_2 = Circle(graft(circle))
divide_surface_2 = DivideSurface(Surface=move_2.Geometry, UCount=number_slider, VCount=number_slider)  # -> Points, Normals, Parameters
circle_3 = Circle(Plane=divide_surface_2.Points, Radius=upper_leg_r)
circle_4 = Circle(graft(circle_3))
loft = Loft(
    Curves=[circle_4, circle_2],
    Options={Adjust=False, Closed=False, LoftEnds=0, LoftSimp=0, LoftType=0, Rebuild=10, Refit=0.01})
solid_union_3 = SolidUnion(Breps=flatten([tree_item_2, loft]))

# ----
# Create hinge pin and rotate top
xy_plane_3 = XYPlane(Origin=construct_point_3)
hinge_hole_size = Slider(0.75, range=0..1)
bottom_brep = Brep(solid_union_3)
top_brep = Brep(cap_holes_7)
full_hinge = Brep(cap_holes_4)
scale_nu_2 = ScaleNU(Geometry=full_hinge, Plane=xy_plane_3, ScaleX=1, ScaleY=hinge_hole_size, ScaleZ=hinge_hole_size)  # -> Geometry, Transform
nail_width = Slider(0.717, range=0..1)
solid_union_4 = SolidUnion(Breps=scale_nu_2.Geometry)
solid_difference_5 = SolidDifference(BrepsA=bottom_brep, BrepsB=solid_union_4)
solid_difference_6 = SolidDifference(BrepsA=top_brep, BrepsB=solid_union_4)
scale_nu_3 = ScaleNU(Geometry=scale_nu_2.Geometry, Plane=xy_plane_3, ScaleX=1, ScaleY=nail_width, ScaleZ=nail_width)  # -> Geometry, Transform
cap_holes_8 = CapHoles(Brep=solid_difference_5)
cap_holes_9 = CapHoles(Brep=solid_difference_6)
cap_holes_10 = CapHoles(Brep=scale_nu_3.Geometry)
pi_2 = Pi(Factor=Slider(1, range=0..1))
rotate_3d_2 = Rotate3D(Geometry=cap_holes_9, Angle=pi_2, Center=construct_point_3, Axis=Vector(1, 0, 0))  # -> Geometry, Transform

solid_union_5 = SolidUnion(Breps=[rotate_3d_2.Geometry, cap_holes_8])
