# Grasshopper definition ProjectShapes.gh (Grasshopper 1.0.8)

# ----
# Lace
width = Slider(50, range=0..1000)
height = Slider(50, range=0..1000)
series = Series(Start=0, Step=1, Count=height)
series_2 = Series(Start=0, Step=1, Count=width)
expression = Expression(l=width, Expression="l/(2*π)")
cross_reference = CrossReference(ListListA=series, ListListB=series_2, CrossMode=1)  # -> ListListA, ListListB
multiplication = Multiplication(A=width, B=0.5)
construct_point = ConstructPoint(XCoordinate=cross_reference.ListListA, YCoordinate=cross_reference.ListListB, ZCoordinate=0)
image_sampler = ImageSampler(
    construct_point,
    FilePath="/Users/a.../Desktop/Masters/Fall24/CSCI7000_ComFab/CSCI-7000-Computational-Fabrication/imgs/proj_laceDesign4.jpeg",
    Filter="Value",
    Interpolate=False,
    Umax=50,
    Umin=1,
    Vmax=50,
    Vmin=1,
    Wrap=1)
unit_y = UnitY(Factor=1)
cylinder = Cylinder(Base=PlaneXY(0, 0, 0), Radius=multiplication, Length=height)
line_sdl = LineSDL(Start=construct_point, Direction=unit_y, Length=image_sampler)
scale_nu = ScaleNU(Geometry=cylinder, Plane=PlaneXY(0, 0, 0), ScaleX=1, ScaleY=0.1, ScaleZ=1)  # -> Geometry, Transform
partition_list = PartitionList(List=line_sdl, Size=width)
end_points = EndPoints(Curve=partition_list)  # -> Start, End
polyline = PolyLine(Vertices=end_points.Start, Closed=False)
polyline_2 = PolyLine(Vertices=end_points.End, Closed=False)
weave = Weave(Pattern=[0, 1], Stream0=polyline, Stream1=polyline_2, NullGaps=False)
loft = Loft(Curves=weave, Options={Adjust=False, Closed=False, LoftEnds=0, LoftSimp=0, LoftType=0, Rebuild=10, Refit=0.01})
numlayers = Slider(1, range=-100..100)
layer_thickness = Slider(0.3, range=0..1)
scale = Scale(Geometry=loft, Center=Point(0, 0, 0), Factor=Slider(1, range=0.1..1))  # -> Geometry, Transform
multiplication_2 = Multiplication(A=numlayers, B=layer_thickness)
deconstruct_domain² = DeconstructDomain²(Domain=scale_nu.Geometry)  # -> UComponent, VComponent
unit_z = UnitZ(Factor=multiplication_2)
extrude = Extrude(Base=scale.Geometry, Direction=unit_z)
bounding_box = BoundingBox(Content=extrude, Plane=PlaneXY(0, 0, 0))  # -> Box, Box_2
surface_morph = SurfaceMorph(
    Geometry=extrude,
    Reference=bounding_box.Box,
    Surface=scale_nu.Geometry,
    UDomain=deconstruct_domain².UComponent,
    VDomain=deconstruct_domain².VComponent,
    WDomain=unit_z)

thickness = Slider(0.3, range=0..1)
numlayers_2 = Slider(1, range=-10..10)
height_2 = Slider(30, range=0..50)
radius = Slider(15, range=0..50)
cylinder_2 = Cylinder(Base=PlaneXY(0, 0, 0), Radius=radius, Length=height_2)
multiplication_3 = Multiplication(A=numlayers_2, B=thickness)
solid_union = SolidUnion(Breps=graft(extrude))
brep = Brep(solid_union)
