# Grasshopper definition project_designs.gh (Grasshopper 1.0.8)

# ----
# Lace
width = Slider(50, range=0..1000)
height = Slider(50, range=0..1000)
series = Series(Start=0, Step=1, Count=height)
series_2 = Series(Start=0, Step=1, Count=width)
expression = Expression(l=width, Expression="l/(2*π)")
cross_reference = CrossReference(ListListA=series, ListListB=series_2, CrossMode=1)  # -> ListListA, ListListB
multiplication = Multiplication(A=width, B=0.5)
construct_point = ConstructPoint(XCoordinate=cross_reference.ListListA, YCoordinate=cross_reference.ListListB, ZCoordinate=0)
image_sampler = ImageSampler(
    construct_point,
    FilePath="/Users/a.../Desktop/Masters/Fall24/CSCI7000_ComFab/CSCI-7000-Computational-Fabrication/imgs/proj_laceDesign4.jpeg",
    Filter="Value",
    Interpolate=False,
    Umax=50,
    Umin=1,
    Vmax=50,
    Vmin=1,
    Wrap=1)
unit_y = UnitY(Factor=1)
cylinder = Cylinder(Base=PlaneXY(0, 0, 0), Radius=multiplication, Length=height)
line_sdl = LineSDL(Start=construct_point, Direction=unit_y, Length=image_sampler)
scale_nu = ScaleNU(Geometry=cylinder, Plane=PlaneXY(0, 0, 0), ScaleX=1, ScaleY=0.1, ScaleZ=1)  # -> Geometry, Transform
partition_list = PartitionList(List=line_sdl, Size=width)
end_points = EndPoints(Curve=partition_list)  # -> Start, End
polyline = PolyLine(Vertices=end_points.Start, Closed=False)
polyline_2 = PolyLine(Vertices=end_points.End, Closed=False)
weave = Weave(Pattern=[0, 1], Stream0=polyline, Stream1=polyline_2, NullGaps=False)
loft = Loft(Curves=weave, Options={Adjust=False, Closed=False, LoftEnds=0, LoftSimp=0, LoftType=0, Rebuild=10, Refit=0.01})
numlayers = Slider(1, range=-100..100)
layer_thickness = Slider(0.3, range=0..1)
scale = Scale(Geometry=loft, Center=Point(0, 0, 0), Factor=Slider(1, range=0.1..1))  # -> Geometry, Transform
multiplication_2 = Multiplication(A=numlayers, B=layer_thickness)
deconstruct_domain² = DeconstructDomain²(Domain=scale_nu.Geometry)  # -> UComponent, VComponent
unit_z = UnitZ(Factor=multiplication_2)
extrude = Extrude(Base=scale.Geometry, Direction=unit_z)
bounding_box = BoundingBox(Content=extrude, Plane=PlaneXY(0, 0, 0))  # -> Box, Box_2
surface_morph = SurfaceMorph(
    Geometry=extrude,
    Reference=bounding_box.Box,
    Surface=scale_nu.Geometry,
    UDomain=deconstruct_domain².UComponent,
    VDomain=deconstruct_domain².VComponent,
    WDomain=unit_z)

# ----
# Lace
number_slider = Slider(490, range=0..1000)
series_3 = Series(Start=0, Step=1, Count=Slider(490, range=0..1000))
series_4 = Series(Start=0, Step=1, Count=number_slider)
cross_reference_2 = CrossReference(ListListA=series_3, ListListB=series_4, CrossMode=1)  # -> ListListA, ListListB
construct_point_2 = ConstructPoint(XCoordinate=cross_reference_2.ListListA, YCoordinate=cross_reference_2.ListListB, ZCoordinate=0)
image_sampler_2 = ImageSampler(construct_point_2, Filter="Value", Interpolate=False, Umax=490, Umin=1, Vmax=490, Vmin=1, Wrap=1)
unit_y_2 = UnitY(Factor=1)
line_sdl_2 = LineSDL(Start=construct_point_2, Direction=unit_y_2, Length=image_sampler_2)
partition_list_2 = PartitionList(List=line_sdl_2, Size=number_slider)
end_points_2 = EndPoints(Curve=partition_list_2)  # -> Start, End
polyline_3 = PolyLine(Vertices=end_points_2.Start, Closed=False)
polyline_4 = PolyLine(Vertices=end_points_2.End, Closed=False)
weave_2 = Weave(Pattern=[0, 1], Stream0=polyline_3, Stream1=polyline_4, NullGaps=False)
loft_2 = Loft(Curves=weave_2, Options={Adjust=False, Closed=False, LoftEnds=0, LoftSimp=0, LoftType=0, Rebuild=10, Refit=0.01})

# ----
# square
layer_thickness_2 = Slider(0.3, range=0..1)
numlayers_2 = Slider(1, range=-100..100)
radius = Slider(30, range=0..100)
multiplication_3 = Multiplication(A=numlayers_2, B=layer_thickness_2)
polygon = Polygon(Plane=PlaneXY(0, 0, 0), Radius=radius, Segments=4, FilletRadius=0)  # -> Polygon, Length
unit_z_2 = UnitZ(Factor=multiplication_3)
boundary_surfaces = BoundarySurfaces(Edges=polygon.Polygon)
extrude_2 = Extrude(Base=boundary_surfaces, Direction=unit_z_2)

# ----
# Lace
number_slider_2 = Slider(490, range=0..1000)
series_5 = Series(Start=0, Step=1, Count=Slider(490, range=0..1000))
series_6 = Series(Start=0, Step=1, Count=number_slider_2)
cross_reference_3 = CrossReference(ListListA=series_5, ListListB=series_6, CrossMode=1)  # -> ListListA, ListListB
construct_point_3 = ConstructPoint(XCoordinate=cross_reference_3.ListListA, YCoordinate=cross_reference_3.ListListB, ZCoordinate=0)
image_sampler_3 = ImageSampler(
    construct_point_3,
    FilePath="/Users/a.../Desktop/Masters/Fall24/CSCI7000_ComFab/CSCI-7000-Computational-Fabrication/imgs/proj_laceDesign.jpg",
    Filter="Value",
    Interpolate=False,
    Umax=490,
    Umin=1,
    Vmax=490,
    Vmin=1,
    Wrap=1)
unit_y_3 = UnitY(Factor=1)
line_sdl_3 = LineSDL(Start=construct_point_3, Direction=unit_y_3, Length=image_sampler_3)
partition_list_3 = PartitionList(List=line_sdl_3, Size=number_slider_2)
end_points_3 = EndPoints(Curve=partition_list_3)  # -> Start, End
polyline_5 = PolyLine(Vertices=end_points_3.Start, Closed=False)
polyline_6 = PolyLine(Vertices=end_points_3.End, Closed=False)
weave_3 = Weave(Pattern=[0, 1], Stream0=polyline_5, Stream1=polyline_6, NullGaps=False)
loft_3 = Loft(Curves=weave_3, Options={Adjust=False, Closed=False, LoftEnds=0, LoftSimp=0, LoftType=0, Rebuild=10, Refit=0.01})

# ----
# Cylinder
radius_2 = Slider(15, range=0..100)
numlayers_3 = Slider(-1, range=-100..100)
layer_thickness_3 = Slider(0.3, range=0..1)
height_2 = Slider(30, range=0..100)
multiplication_4 = Multiplication(A=numlayers_3, B=layer_thickness_3)
unit_z_3 = UnitZ(Factor=height_2)
circle = Circle(Plane=PlaneXY(0, 0, 0), Radius=radius_2)
boundary_surfaces_2 = BoundarySurfaces(Edges=circle)
offset_curve = OffsetCurve(Curve=circle, Distance=multiplication_4, Corners=1)
boundary_surfaces_3 = BoundarySurfaces(Edges=offset_curve)
region_difference = RegionDifference(CurvesA=boundary_surfaces_2, CurvesB=boundary_surfaces_3)
boundary_surfaces_4 = BoundarySurfaces(Edges=region_difference)
extrude_3 = Extrude(Base=boundary_surfaces_4, Direction=unit_z_3)

layer_thickness_4 = Slider(0.3, range=0..1)
height_3 = Slider(30, range=0..100)
radius_3 = Slider(15, range=0..100)
numlayers_4 = Slider(-1, range=-100..100)
multiplication_5 = Multiplication(A=numlayers_4, B=layer_thickness_4)
cylinder_2 = Cylinder(Base=PlaneXY(0, 0, 0), Radius=radius_3, Length=height_3)
offset_surface = OffsetSurface(Surface=cylinder_2, Distance=multiplication_5, Retrim=True)
cap_holes = CapHoles(Brep=offset_surface)
cap_holes_2 = CapHoles(Brep=cylinder_2)
solid_difference = SolidDifference(BrepsA=cap_holes_2, BrepsB=cap_holes)
brep = Brep(solid_difference)
surface = Surface(extrude)
